# Grasshopper definition 113_change_basis_and_transformation_between_frames.ghx (Grasshopper 1.0.7)

# ----
# 1 Point
pt = Point(Point(0.2327979526, 0.3652752344, 0.05481222491))
py = GhPythonScript(pt=pt)  # -> point
# ---------- py: Python ----------
from compas.geometry import Point

point = Point(pt.X, pt.Y, pt.Z)
# ---------- end py ----------

# ----
# 2 Frames
py_2 = GhPythonScript()  # -> F2
# ---------- py_2: Python ----------
from compas.geometry import Frame


F2 = Frame((0.8, 0.5, 0.5), [0.68, 0.68, 0.27], [-0.67, 0.73, -0.15])
# ---------- end py_2 ----------
py_3 = GhPythonScript()  # -> F1
# ---------- py_3: Python ----------
from compas.geometry import Frame

F1 = Frame.worldXY()
# ---------- end py_3 ----------

# ----
# Transformation between two frames
f2f = GhPythonScript(F1=py_3, F2=py_2)  # -> T
# ---------- f2f: Python ----------
from compas.geometry import Transformation

# change-basis transformation between two frames F1 and F2.
T = Transformation.from_frame_to_frame(F1, F2)
# ---------- end f2f ----------
py_4 = GhPythonScript(point=py, T=f2f)  # -> point_transformed
# ---------- py_4: Python ----------
point_transformed = point.transformed(T)
# ---------- end py_4 ----------
py_5 = GhPythonScript(F1=py_3, F2=py_2, point=py, point_transformed=py_4)  # -> P, A, V
# ---------- py_5: Python ----------
from compas.artists import Artist
import Rhino.Geometry as rg

# display
P = Artist(point_transformed).draw()
v = point_transformed - F2.point

A = [Artist(F1.point).draw(), Artist(F2.point).draw()]
V = [rg.Vector3d(*list(point)), rg.Vector3d(*list(v))]
# ---------- end py_5 ----------
pt_2 = Point(py_5.P)
vdis = VectorDisplay(Anchor=py_5.A, Vector=py_5.V)

draw = GhPythonScript(frames=[py_2, py_3], scale=Slider(0.1, range=0..1))  # -> P, V, C, W; inputs frames: list
# ---------- draw: Python ----------
from System.Drawing import Color
from compas_ghpython.utilities import draw_frame

red = Color.FromArgb(255, 0, 0)
green = Color.FromArgb(0, 255, 0)
blue = Color.FromArgb(0, 0, 255)

P = []
V = []
C = []

scale = float(scale)

for frame in frames:
    if not frame:
        continue
    plane = draw_frame(frame)
    P += [plane.Origin] * 3
    V.append(plane.XAxis * scale)
    V.append(plane.YAxis * scale)
    V.append(plane.ZAxis * scale)
    C += [red, green, blue]

W = 3
# ---------- end draw ----------
vdisex = VectorDisplayEx(Point=draw.P, Vector=draw.V, Colour=draw.C, Width=draw.W)

# ----
# Change-basis transformation
cob = GhPythonScript(F1=py_3, F2=py_2)  # -> T
# ---------- cob: Python ----------
from compas.geometry import Transformation

# change-basis transformation between two frames F1 and F2.
T = Transformation.from_change_of_basis(F1, F2)
# ---------- end cob ----------

py_6 = GhPythonScript(point=py, T=cob)  # -> point_transformed; same code as py_4

py_7 = GhPythonScript(F2=py_2, point_transformed=py_6)  # -> A, V
# ---------- py_7: Python ----------
from compas.artists import Artist
import Rhino.Geometry as rg

x, y, z = point_transformed

A = []
V = []
A.append(F2.point)
V.append(F2.xaxis * x)
A.append(A[-1] + V[-1])
V.append(F2.yaxis * y)
A.append(A[-1] + V[-1])
V.append(F2.zaxis * z)

# display
A = [Artist(p).draw() for p in A]
V = [rg.Vector3d(*list(v)) for v in V]
# ---------- end py_7 ----------
vdis_2 = VectorDisplay(Anchor=py_7.A, Vector=py_7.V)
