# Grasshopper definition 118_rotations.ghx (Grasshopper 1.0.7)

box = GhPythonScript()  # -> frame, box
# ---------- box: Python ----------
from compas.geometry import Frame
from compas.geometry import Box

width, length, height = 1, 1, 1
box = Box(Frame.worldXY(), width, length, height)

frame = box.frame
# ---------- end box ----------

# ----
# Euler angles
alpha = Slider(0, range=-180..180)
beta = Slider(0, range=-180..180)
gamma = Slider(0, range=-180..180)
rad = Radians(Degrees=alpha)
rad_2 = Radians(Degrees=beta)
rad_3 = Radians(Degrees=gamma)
list = ValueList({"xyz", "xyx"}, selected="xyz")
euler_angles = GhPythonScript(alpha=rad, beta=rad_2, gamma=rad_3, static=Toggle(False), axes=list)  # -> R
# ---------- euler_angles: Python ----------
from compas.geometry import Rotation

R = Rotation.from_euler_angles([alpha, beta, gamma], static, axes)
# ---------- end euler_angles ----------
py = GhPythonScript(box=box.box, R=euler_angles)  # -> out, frame_transformed, box_transformed
# ---------- py: Python ----------
from compas.geometry import Rotation

box_transformed = box.transformed(R)
frame_transformed = box_transformed.frame

print("axis and angle", Rotation.from_frame(box_transformed.frame).axis_and_angle)
print("axis_angle_vector", box_transformed.frame.axis_angle_vector)
print("quaternion", box_transformed.frame.quaternion)
# ---------- end py ----------
draw = GhPythonScript(box=py.box_transformed)  # -> B
# ---------- draw: Python ----------
from compas.artists import Artist
B = Artist(box).draw()
# ---------- end draw ----------
panel = Panel(py.out)

# ----
# Axis and angle
angle = Slider(69, range=-180..180)
number_slider = Slider(0.1, range=-1..1)
number_slider_2 = Slider(-1, range=-1..1)
number_slider_3 = Slider(0.1, range=-3..3)
rad_4 = Radians(Degrees=angle)
vec = VectorXYZ(XComponent=number_slider, YComponent=number_slider_2, ZComponent=number_slider_3)  # -> Vector, Length
axis_and_angle = GhPythonScript(axis_x=number_slider, axis_y=number_slider_2, axis_z=number_slider_3, angle=rad_4)  # -> R
# ---------- axis_and_angle: Python ----------
from compas.geometry import Rotation
from compas.geometry import Vector

axis = Vector(axis_x, axis_y, axis_z)
axis.unitize()

aav = axis * angle

R = Rotation.from_axis_angle_vector(aav)
# ---------- end axis_and_angle ----------
vdis = VectorDisplay(Anchor=Point(0, 0, 0), Vector=vec.Vector)
py_2 = GhPythonScript(box=box.box, R=axis_and_angle)  # -> out, box_transformed
# ---------- py_2: Python ----------
from compas.geometry import Rotation

box_transformed = box.transformed(R)


print("axis and angle", Rotation.from_frame(box_transformed.frame).axis_and_angle)
print("axis_angle_vector", box_transformed.frame.axis_angle_vector)
print("quaternion", box_transformed.frame.quaternion)
# ---------- end py_2 ----------
panel_2 = Panel(py_2.out)
draw_2 = GhPythonScript(box=py_2.box_transformed)  # -> B; same code as draw

# ----
# Quaternion
number_slider_4 = Slider(0.82, range=-1..1)
# Compared to Euler angles, unit quaternions are simpler to compose and compared to rotation matrices they are more compact, more numerically stable, and more efficient.
number_slider_5 = Slider(0.056, range=-1..1)
quaternion = GhPythonScript(w=number_slider_4, x=Slider(0.056, range=-1..1), y=Slider(-0.561, range=-1..1), z=number_slider_5)  # -> R
# ---------- quaternion: Python ----------
from compas.geometry import Quaternion
from compas.geometry import Rotation

quaternion = Quaternion(w, x, y, z).unitized()


R = Rotation.from_quaternion(quaternion)
# ---------- end quaternion ----------
py_3 = GhPythonScript(box=box.box, R=quaternion)  # -> out, box_transformed; same code as py_2
panel_3 = Panel(py_3.out)
draw_3 = GhPythonScript(box=py_3.box_transformed)  # -> B; same code as draw

draw_4 = GhPythonScript(box=box.box)  # -> B; same code as draw
draw_5 = GhPythonScript(frames=box.frame, scale=Slider(1, range=0..1))  # -> P, V, C, W; inputs frames: list
# ---------- draw_5: Python ----------
from System.Drawing import Color
from compas_ghpython.utilities import draw_frame

red = Color.FromArgb(255, 0, 0)
green = Color.FromArgb(0, 255, 0)
blue = Color.FromArgb(0, 0, 255)

P = []
V = []
C = []

scale = float(scale)

for frame in frames:
    if not frame:
        continue
    plane = draw_frame(frame)
    P += [plane.Origin] * 3
    V.append(plane.XAxis * scale)
    V.append(plane.YAxis * scale)
    V.append(plane.ZAxis * scale)
    C += [red, green, blue]

W = 3
# ---------- end draw_5 ----------
vdisex = VectorDisplayEx(Point=draw_5.P, Vector=draw_5.V, Colour=draw_5.C, Width=draw_5.W)
draw_6 = GhPythonScript(frames=py.frame_transformed, scale=Slider(1, range=0..1))  # -> P, V, C, W; inputs frames: list; same code as draw_5
vdisex_2 = VectorDisplayEx(Point=draw_6.P, Vector=draw_6.V, Colour=draw_6.C, Width=draw_6.W)
