# Grasshopper definition 207_robot_artist_grasshopper.ghx (Grasshopper 1.0.7)

# ---- group: set config
# Configuration
a1 = Slider(0, range=-360..360)
a2 = Slider(0, range=-360..360)
a3 = Slider(0, range=-360..360)
a4 = Slider(0, range=-360..360)
a5 = Slider(0, range=-360..360)
a6 = Slider(0, range=-360..360)
config = PythonScript(vals=[a1, a2, a3, a4, a5, a6])  # -> config; inputs vals: list
# ---------- config: Python ----------
import math
from compas.robots import Configuration

config = Configuration.from_revolute_values([math.radians(a) for a in vals])
# ---------- end config ----------

# ----
# Robot
load = Button()
python = PythonScript(load=load)  # -> model, artist
# ---------- python: Python ----------
from scriptcontext import sticky as st

import compas

from compas.artists import Artist
from compas.robots import RobotModel

# Robot meshes are usually in meters
# Set a high percision to prevent parsing errors
# and configure Rhino itself in meters
compas.PRECISION = '12f'

# Store robot in component-based key
model_key = 'model_{}'.format(str(ghenv.Component.InstanceGuid))
artist_key = 'artist_{}'.format(str(ghenv.Component.InstanceGuid))

if model_key not in st:
    st[model_key] = None
if artist_key not in st:
    st[artist_key] = None

if load:
    model = RobotModel.ur5(load_geometry=True)
    artist = Artist(model)

    st[model_key] = model
    st[artist_key] = artist

model = st[model_key]
artist = st[artist_key]
# ---------- end python ----------
robotmodel = Data(python.model)

# ----
# Visualisation
visualize = GhPythonScript(model=robotmodel, artist=python.artist, config=config)  # -> out, a
# ---------- visualize: Python ----------
new_config = model.zero_configuration()
new_config.joint_values = config.joint_values
artist.update(new_config)
a = artist.draw_visual()
# ---------- end visualize ----------
