# Grasshopper definition 217_inverse_kinematics.ghx (Grasshopper 1.0.7)

reload = Button()

# ----
# Robot
load = Button()
python = PythonScript(load=load)  # -> model, artist
# ---------- python: Python ----------
from scriptcontext import sticky as st
import os
import compas

from compas.robots import RobotModel
from compas.artists import Artist

# Robot meshes are usually in meters
# Set a high percision to prevent parsing errors
# and configure Rhino itself in meters
compas.PRECISION = '12f'

# Store robot in component-based key
model_key = 'model_{}'.format(str(ghenv.Component.InstanceGuid))
artist_key = 'artist_{}'.format(str(ghenv.Component.InstanceGuid))

ghfile = ghenv.Component.OnPingDocument().FilePath

if model_key not in st:
    st[model_key] = None
if artist_key not in st:
    st[artist_key] = None

if load:
    model = RobotModel.ur5(load_geometry=True)
    artist = Artist(model)

    st[model_key] = model
    st[artist_key] = artist

model = st[model_key]
artist = st[artist_key]
# ---------- end python ----------

# ---- group: set config
# Configuration
pt = Point(Point(0.4079095033, 0.05260285023, 0.2782116813))
xz = XZPlane(Origin=pt)
python_2 = GhPythonScript(plane=xz)  # -> configurations
# ---------- python_2: Python ----------
from compas.geometry import Frame
from compas.robots import Configuration
from compas_fab.backends.kinematics.solvers import UR5Kinematics

f = Frame(plane.Origin, plane.XAxis, plane.ZAxis)

configurations = []
for jv in UR5Kinematics().inverse(f):
    configurations.append(Configuration.from_revolute_values(jv))
# ---------- end python_2 ----------
item = ListItem(List=python_2, Index=Slider(0, range=0..7), Wrap=True)

# ----
py = PythonScript(reload=reload)
# ---------- py: Python ----------
if reload:
    from compas_ghpython import unload_modules
    unload_modules('compas')
# ---------- end py ----------

# ----
# Visualisation
visualize = GhPythonScript(model=python.model, artist=python.artist, config=item)  # -> out, a
# ---------- visualize: Python ----------
jv = config.joint_values

config = model.zero_configuration()
config.joint_values = jv

artist.update(config)
a = artist.draw()
# ---------- end visualize ----------
