# Grasshopper definition BYOR_tiziano-kunal.gh (Grasshopper 1.0.7)

number_slider = Slider(0.6, range=0..0.6)

# ---- group: 2 axis
neg = Negative(Value=number_slider)
multiplication = Multiplication(A="3.14", B=[number_slider, neg])
python = GhPythonScript(A1=multiplication, A2=multiplication)  # -> robot, a
# ---------- python: Python ----------
from compas.artists import Artist
from compas.robots import Configuration
        
from compas.datastructures import Mesh
from compas.geometry import Circle
from compas.geometry import Cylinder
from compas.geometry import Frame
from compas.geometry import Plane, Point, Sphere
from compas.geometry import Translation
from compas.robots import Joint
from compas.robots import RobotModel
from compas.robots import configuration
        
# create cylinder in yz plane
length = 5
radius1 = 0.5
radius2 = 0.25
        
cylinder1 = Cylinder(Circle(Plane([0, 0, 0], [1, 0, 0]), radius1), length)
cylinder2 = Cylinder(Circle(Plane([0, 0, 0], [1, 0, 0]), radius2), length*1.5)
        
sphere = Sphere(Point(0,0,0),1)
        
cylinder1.transform(Translation.from_vector([length / 2., 0, 0]))
cylinder2.transform(Translation.from_vector([length / 1.2, 0, 0]))
        
# create robot
model = RobotModel("robot", links=[], joints=[])
        
# add first link to robot
link0 = model.add_link("world")
        
########################first axis
# add second link to robot
mesh1 = Mesh.from_shape(cylinder1)
mesh2 = Mesh.from_shape(cylinder2)
        
        
axis = (0, 0, 1)
origin = Frame.worldXY()
origin1 = Frame((4.5, 0, 0), (1, 0, 0), (0, 1, 0))
origin = Frame((length, 0, 0), (1, 0, 0), (0, -1, 0))
origin = Frame((length, 0, 0), (1, 0, 0), (0, 1, 0))
#origin = Frame((length, 0, 0), (1, 0, 0), (0, -1, 0))
        
color = (0,0,0)
        
link1 = model.add_link("link1", visual_mesh=mesh1, visual_color=(color))
link2 = model.add_link("link2", visual_mesh=mesh2, visual_color=(color))
        
model.add_joint("joint1", Joint.CONTINUOUS, link0, link1, origin1, axis)
model.add_joint("joint2", Joint.CONTINUOUS, link1, link2, origin, axis)
        
        
# Create a configuration object matching the number of joints in your model
configuration = model.zero_configuration()
configuration ['joint1'] = A1
configuration ['joint2'] = A2
        
        
# Update the model using the artist
artist = Artist(model)
artist.update(configuration)
        
# Render everything
robot = artist.draw_visual()
# ---------- end python ----------

# ----
neg_2 = Negative(Value=number_slider)

# ---- group: 3 Axis
multiplication_2 = Multiplication(A="2.10", B=[number_slider, neg_2])
python_2 = GhPythonScript(A1=multiplication_2, A2=multiplication_2, A3=multiplication_2)  # -> robot
# ---------- python_2: Python ----------
from compas.artists import Artist
from compas.robots import Configuration

from compas.datastructures import Mesh
from compas.geometry import Circle
from compas.geometry import Cylinder
from compas.geometry import Frame
from compas.geometry import Plane
from compas.geometry import Translation
from compas.robots import Joint
from compas.robots import RobotModel
from compas.robots import configuration

# create cylinder in yz plane
length = 5
radius1 = 0.6
radius2 = 0.35
radius3 = 0.2

cylinder1 = Cylinder(Circle(Plane([0, 0, 0], [1, 0, 0]), radius1), length)
cylinder2 = Cylinder(Circle(Plane([0, 0, 0], [1, 0, 0]), radius2), length)
cylinder3 = Cylinder(Circle(Plane([0, 0, 0], [1, 0, 0]), radius3), length*2.5)

cylinder1.transform(Translation.from_vector([length / 2., 0, 0]))
cylinder2.transform(Translation.from_vector([length / 2., 0, 0]))
cylinder3.transform(Translation.from_vector([length /0.8, 0, 0]))


# create robot
model = RobotModel("robot", links=[], joints=[])

# add first link to robot
link0 = model.add_link("world")

########################first axis
# add second link to robot
mesh1 = Mesh.from_shape(cylinder1)
mesh2 = Mesh.from_shape(cylinder2)
mesh3= Mesh.from_shape(cylinder3)


axis = (0, 0, 1)
#origin = Frame.worldXY()
origin = Frame((length, 0, 0), (1, 0, 0), (0, 1, 0))

color = (0.1,0,0)

link1 = model.add_link("link1", visual_mesh=mesh1, visual_color=(color))
link2 = model.add_link("link2", visual_mesh=mesh2, visual_color=(color))
link3 = model.add_link("link3", visual_mesh=mesh3, visual_color=(color))

model.add_joint("joint1", Joint.CONTINUOUS, link0, link1, origin, axis)
model.add_joint("joint2", Joint.CONTINUOUS, link1, link2, origin, axis)
model.add_joint("joint3", Joint.CONTINUOUS, link2, link3, origin, axis) 


# Create a configuration object matching the number of joints in your model
configuration = model.zero_configuration()
configuration ['joint1'] = A1
configuration ['joint2'] = A2
configuration ['joint3'] = A3
#configuration ['joint4'] = A4


# Update the model using the artist
artist = Artist(model)
artist.update(configuration)

# Render everything
robot = artist.draw_visual()
# ---------- end python_2 ----------

# ----
neg_3 = Negative(Value=number_slider)

# ---- group: 5 Axis
neg_4 = Negative(Value=number_slider)
multiplication_3 = Multiplication(A="1.26", B=[number_slider, neg_4])
python_3 = GhPythonScript(A1=multiplication_3, A2=multiplication_3, A3=multiplication_3, A4=multiplication_3, A5=multiplication_3)  # -> robot
# ---------- python_3: Python ----------
from compas.artists import Artist
from compas.robots import Configuration

from compas.datastructures import Mesh
from compas.geometry import Circle
from compas.geometry import Cylinder
from compas.geometry import Frame
from compas.geometry import Plane
from compas.geometry import Translation
from compas.robots import Joint
from compas.robots import RobotModel
from compas.robots import configuration

# create cylinder in yz plane
length = 5
radius1 = 0.8
radius2 = 0.7
radius3 = 0.6
radius4 = 0.4
radius5 = 0.2


cylinder1 = Cylinder(Circle(Plane([0, 0, 0], [1, 0, 0]), radius1), length)
cylinder2 = Cylinder(Circle(Plane([0, 0, 0], [1, 0, 0]), radius2), length)
cylinder3 = Cylinder(Circle(Plane([0, 0, 0], [1, 0, 0]), radius3), length)
cylinder4 = Cylinder(Circle(Plane([0, 0, 0], [1, 0, 0]), radius4), length)
cylinder5 = Cylinder(Circle(Plane([0, 0, 0], [1, 0, 0]), radius5), length*4.5)


cylinder1.transform(Translation.from_vector([length / 2., 0, 0]))
cylinder2.transform(Translation.from_vector([length / 2., 0, 0]))
cylinder3.transform(Translation.from_vector([length / 2., 0, 0]))
cylinder4.transform(Translation.from_vector([length / 2., 0, 0]))
cylinder5.transform(Translation.from_vector([length / 0.5, 0, 0]))

# create robot
model = RobotModel("robot", links=[], joints=[])

# add first link to robot
link0 = model.add_link("world")

########################first axis
# add second link to robot
mesh1 = Mesh.from_shape(cylinder1)
mesh2 = Mesh.from_shape(cylinder2)
mesh3 = Mesh.from_shape(cylinder3)
mesh4 = Mesh.from_shape(cylinder4)
mesh5 = Mesh.from_shape(cylinder5)




axis = (0, 0, 1)
origin = Frame.worldXY()
origin1 = Frame((11, 0, 0), (1, 0, 0), (0, 1, 0))
origin2 = Frame((length, 0, 0), (1, 0, 0), (0, 1, 0))
origin3 = Frame((length, 0, 0), (1, 0, 0), (0, 1, 0))
origin4 = Frame((length, 0, 0), (1, 0, 0), (0, 1, 0))
origin5 = Frame((length, 0, 0), (1, 0, 0), (0, 1, 0))
#origin = Frame((length, 0, 0), (1, 0, 0), (0, -1, 0))

color = (0.6,0,0)

link1 = model.add_link("link1", visual_mesh=mesh1, visual_color=(color))
link2 = model.add_link("link2", visual_mesh=mesh2, visual_color=(color))
link3 = model.add_link("link3", visual_mesh=mesh3, visual_color=(color))
link4 = model.add_link("link4", visual_mesh=mesh4, visual_color=(color))
link5 = model.add_link("link5", visual_mesh=mesh5, visual_color=(color))
#link6 = model.add_link("link6", visual_mesh=mesh, visual_color=(0.6, 0.1, 0.5))

model.add_joint("joint1", Joint.CONTINUOUS, link0, link1, origin1, axis)
model.add_joint("joint2", Joint.CONTINUOUS, link1, link2, origin2, axis)
model.add_joint("joint3", Joint.CONTINUOUS, link2, link3, origin3, axis) 
model.add_joint("joint4", Joint.CONTINUOUS, link3, link4, origin4, axis) 
model.add_joint("joint5", Joint.CONTINUOUS, link4, link5, origin5, axis) 
#model.add_joint("joint6", Joint.CONTINUOUS, link5, link6, origin, axis) 


# Create a configuration object matching the number of joints in your model
configuration = model.zero_configuration()
configuration ['joint1'] = A1
configuration ['joint2'] = A2
configuration ['joint3'] = A3
configuration ['joint4'] = A4
configuration ['joint5'] = A5
#configuration ['joint6'] = A6


# Update the model using the artist
artist = Artist(model)
artist.update(configuration)

# Render everything
robot = artist.draw_visual()
# ---------- end python_3 ----------

# ---- group: 6 Axis
neg_5 = Negative(Value=number_slider)
multiplication_4 = Multiplication(A="1.05", B=[number_slider, neg_5])
python_4 = GhPythonScript(
    A1=multiplication_4,
    A2=multiplication_4,
    A3=multiplication_4,
    A4=multiplication_4,
    A5=multiplication_4,
    A6=multiplication_4)  # -> robot
# ---------- python_4: Python ----------
from compas.artists import Artist
from compas.robots import Configuration

from compas.datastructures import Mesh
from compas.geometry import Circle
from compas.geometry import Cylinder
from compas.geometry import Frame
from compas.geometry import Plane
from compas.geometry import Translation
from compas.robots import Joint
from compas.robots import RobotModel
from compas.robots import configuration

# create cylinder in yz plane
length =5
radius1 = 0.8
radius2 = 0.6
radius3 = 0.5
radius4 = 0.3
radius5 = 0.2
radius6 = 0.1

cylinder1 = Cylinder(Circle(Plane([0, 0, 0], [1, 0, 0]), radius1), length)
cylinder2 = Cylinder(Circle(Plane([0, 0, 0], [1, 0, 0]), radius2), length)
cylinder3 = Cylinder(Circle(Plane([0, 0, 0], [1, 0, 0]), radius3), length)
cylinder4 = Cylinder(Circle(Plane([0, 0, 0], [1, 0, 0]), radius4), length)
cylinder5 = Cylinder(Circle(Plane([0, 0, 0], [1, 0, 0]), radius5), length)
cylinder6 = Cylinder(Circle(Plane([0, 0, 0], [1, 0, 0]), radius6), 27)

cylinder1.transform(Translation.from_vector([length / 2., 0, 0]))
cylinder2.transform(Translation.from_vector([length / 2., 0, 0]))
cylinder3.transform(Translation.from_vector([length / 2., 0, 0]))
cylinder4.transform(Translation.from_vector([length / 2., 0, 0]))
cylinder5.transform(Translation.from_vector([length / 2., 0, 0]))
cylinder6.transform(Translation.from_vector([length/0.4, 0, 0]))


# create robot
model = RobotModel("robot", links=[], joints=[])

# add first link to robot
link0 = model.add_link("world")

########################first axis
# add second link to robot
mesh1 = Mesh.from_shape(cylinder1)
mesh2 = Mesh.from_shape(cylinder2)
mesh3 = Mesh.from_shape(cylinder3)
mesh4 = Mesh.from_shape(cylinder4)
mesh5 = Mesh.from_shape(cylinder5)
mesh6 = Mesh.from_shape(cylinder6)


axis = (0, 0, 1)
origin = Frame.worldXY()
origin1 = Frame((14, 0, 0), (1, 0, 0), (0, 1, 0))
origin2 = Frame((length, 0, 0), (1, 0, 0), (0, 1, 0))
origin3 = Frame((length, 0, 0), (1, 0, 0), (0, 1, 0))
origin4 = Frame((length, 0, 0), (1, 0, 0), (0, 1, 0))
origin5 = Frame((length, 0, 0), (1, 0, 0), (0, 1, 0))
origin6 = Frame((length, 0, 0), (1, 0, 0), (0, 1, 0))


color = (0.9, 0, 0)
link1 = model.add_link("link1", visual_mesh=mesh1, visual_color=(color))
link2 = model.add_link("link2", visual_mesh=mesh2, visual_color=(color))
link3 = model.add_link("link3", visual_mesh=mesh3, visual_color=(color))
link4 = model.add_link("link4", visual_mesh=mesh4, visual_color=(color))
link5 = model.add_link("link5", visual_mesh=mesh5, visual_color=(color))
link6 = model.add_link("link6", visual_mesh=mesh6, visual_color=(color))

model.add_joint("joint1", Joint.CONTINUOUS, link0, link1, origin1, axis)
model.add_joint("joint2", Joint.CONTINUOUS, link1, link2, origin2, axis)
model.add_joint("joint3", Joint.CONTINUOUS, link2, link3, origin3, axis) 
model.add_joint("joint4", Joint.CONTINUOUS, link3, link4, origin4, axis) 
model.add_joint("joint5", Joint.CONTINUOUS, link4, link5, origin5, axis) 
model.add_joint("joint6", Joint.CONTINUOUS, link5, link6, origin6, axis) 


# Create a configuration object matching the number of joints in your model
configuration = model.zero_configuration()
configuration ['joint1'] = A1
configuration ['joint2'] = A2
configuration ['joint3'] = A3
configuration ['joint4'] = A4
configuration ['joint5'] = A5
configuration ['joint6'] = A6


# Update the model using the artist
artist = Artist(model)
artist.update(configuration)

# Render everything
robot = artist.draw_visual()
# ---------- end python_4 ----------

# ---- group: 4 Axis
multiplication_5 = Multiplication(A="1.57", B=[number_slider, neg_3])
python_5 = GhPythonScript(A1=multiplication_5, A2=multiplication_5, A3=multiplication_5, A4=multiplication_5)  # -> robot
# ---------- python_5: Python ----------
from compas.artists import Artist
from compas.robots import Configuration

from compas.datastructures import Mesh
from compas.geometry import Circle
from compas.geometry import Cylinder
from compas.geometry import Frame
from compas.geometry import Plane
from compas.geometry import Translation
from compas.robots import Joint
from compas.robots import RobotModel
from compas.robots import configuration

# create cylinder in yz plane
length =  5
radius1 = 0.8
radius2 = 0.6
radius3 = 0.4
radius4 = 0.2
cylinder1 = Cylinder(Circle(Plane([0, 0, 0], [1, 0, 0]), radius1), length)
cylinder2 = Cylinder(Circle(Plane([0, 0, 0], [1, 0, 0]), radius2), length)
cylinder3 = Cylinder(Circle(Plane([0, 0, 0], [1, 0, 0]), radius3), length)
cylinder4 = Cylinder(Circle(Plane([0, 0, 0], [1, 0, 0]), radius4), length*3.5)




cylinder1.transform(Translation.from_vector([length / 2, 0, 0]))
cylinder2.transform(Translation.from_vector([length / 2, 0, 0]))
cylinder3.transform(Translation.from_vector([length / 2, 0, 0]))
cylinder4.transform(Translation.from_vector([length / 0.6, 0, 0]))

# create robot
model = RobotModel("robot", links=[], joints=[])

# add first link to robot
link0 = model.add_link("world")

########################first axis
# add second link to robot
mesh1 = Mesh.from_shape(cylinder1)
mesh2 = Mesh.from_shape(cylinder2)
mesh3 = Mesh.from_shape(cylinder3)
mesh4 = Mesh.from_shape(cylinder4)



axis = (0, 0, 1)
origin = Frame.worldXY()
origin1 = Frame((8, 0, 0), (1, 0, 0), (0, 1, 0))
origin2 = Frame((length, 0, 0), (1, 0, 0), (0, 1, 0))
origin3 = Frame((length, 0, 0), (1, 0, 0), (0, 1, 0))
origin4 = Frame((length, 0, 0), (1, 0, 0), (0, 1, 0))

color = (0.3,0,0)

link1 = model.add_link("link1", visual_mesh=mesh1, visual_color=(color))
link2 = model.add_link("link2", visual_mesh=mesh2, visual_color=(color))
link3 = model.add_link("link3", visual_mesh=mesh3, visual_color=(color))
link4 = model.add_link("link4", visual_mesh=mesh4, visual_color=(color))
#link5 = model.add_link("link5", visual_mesh=mesh, visual_color=(0.6, 0.1, 0.5))
#link5 = model.add_link("link6", visual_mesh=mesh, visual_color=(0.6, 0.1, 0.5))

model.add_joint("joint1", Joint.CONTINUOUS, link0, link1, origin1, axis)
model.add_joint("joint2", Joint.CONTINUOUS, link1, link2, origin2, axis)
model.add_joint("joint3", Joint.CONTINUOUS, link2, link3, origin3, axis) 
model.add_joint("joint4", Joint.CONTINUOUS, link3, link4, origin4, axis) 
#model.add_joint("joint5", Joint.CONTINUOUS, link4, link5, origin, axis) 
#model.add_joint("joint6", Joint.CONTINUOUS, link5, link6, origin, axis) 


# Create a configuration object matching the number of joints in your model
configuration = model.zero_configuration()
configuration ['joint1'] = A1
configuration ['joint2'] = A2
configuration ['joint3'] = A3
configuration ['joint4'] = A4


# Update the model using the artist
artist = Artist(model)
artist.update(configuration)

# Render everything
robot = artist.draw_visual()
# ---------- end python_5 ----------
