# Grasshopper definition 220316_Assigment_2_CW_AK.ghx (Grasshopper 1.0.7)

python = GhPythonScript(config=[Slider(-0.97, range=-3.14..3.14), Slider(0.96, range=-3.14..3.14), Slider(1.16, range=-3.14..3.14), Slider(-1.35, range=-3.14..3.14), Slider(0.67, range=-3.14..3.14), Slider(0.67, range=-3.14..3.14), Slider(-0.87, range=-3.14..3.14), Slider(0.43, range=-3.14..3.14), Slider(0.77, range=-3.14..3.14)])  # -> out, art; inputs config: list
# ---------- python: Python ----------
from compas.artists import Artist
from compas.datastructures import Mesh
from compas.geometry import Circle
from compas.geometry import Cylinder
from compas.geometry import Torus
from compas.geometry import Frame
from compas.geometry import Plane
from compas.geometry import Translation
from compas.geometry import Rotation
from compas.robots import Configuration
from compas.robots import Joint
from compas.robots import RobotModel
from compas.robots import Limit
import math

# create cylinder in yz plane
radius, length, length_ = 0.3, 5, 1

cylinder = Cylinder(Circle(Plane([0, 0, 0], [1, 0, 0]), radius), length)
cylinder.transform(Translation.from_vector([length / 2.0, 0, 0]))

torus = Torus(Plane([0,0,0],[0,0,1]),length_,0.2)

# create robot model
model = RobotModel("robot", links=[], joints=[])

# link meshes (calling Mesh.from_shape effectively creates a copy of the shape)
leg_a = Mesh.from_shape(cylinder)
leg_b = Mesh.from_shape(cylinder)
torso = Mesh.from_shape(cylinder)
arm_a = Mesh.from_shape(cylinder)
arm_b = Mesh.from_shape(cylinder)
neck = Mesh.from_shape(Cylinder(Circle(Plane([0, 0, 0], [1, 0, 0]), radius), length_))
head = Mesh.from_shape(torus)

leg_leg_a = Mesh.from_shape(cylinder)
leg_leg_b = Mesh.from_shape(cylinder)
leg_leg_p = Mesh.from_shape(cylinder)
leg_leg_q = Mesh.from_shape(cylinder)

# add links
link0 = model.add_link("world")
link1 = model.add_link("link1", visual_mesh=leg_a, visual_color=(0.2, 0.5, 0.6))
link2 = model.add_link("link2", visual_mesh=leg_b, visual_color=(0.55, 0.6, 0.2))
link3 = model.add_link("link3", visual_mesh=arm_a, visual_color=(0.25, 0.6, 0.2))
link4 = model.add_link("link4", visual_mesh=arm_b, visual_color=(0.2, 0.3, 0.2))
link5 = model.add_link("link5", visual_mesh=neck, visual_color=(0.6, 0.8, 0.2))
link6 = model.add_link("link6", visual_mesh=head, visual_color=(0.8, 0.8, 0.2))
link7 = model.add_link("link7", visual_mesh=torso, visual_color=(0.56, 0.8, 0.2))

link8 = model.add_link("link8", visual_mesh=leg_leg_a, visual_color=(0.56, 0.8, 0.2))
link9 = model.add_link("link9", visual_mesh=leg_leg_b, visual_color=(0.56, 0.8, 0.2))
link10 = model.add_link("link10", visual_mesh=leg_leg_p, visual_color=(0.56, 0.8, 0.2))
link11 = model.add_link("link11", visual_mesh=leg_leg_q, visual_color=(0.56, 0.8, 0.2))

# add joints between the links
axis = (0, 0, 1)
origin = Frame.worldXY()
frame = Frame((length, 0, 0), (1, 0, 0), (0, 1, 0))

model.add_joint("joint0", Joint.FIXED, link0, link7, origin, axis)
model.add_joint("joint1", Joint.CONTINUOUS, link7, link1, frame, axis)
model.add_joint("joint2", Joint.CONTINUOUS, link7, link2, frame, axis)
model.add_joint("joint3", Joint.CONTINUOUS, link7, link3, Frame((0, 0, 0), (1, 0, 0), (0, 1, 0)), axis)
model.add_joint("joint4", Joint.CONTINUOUS, link7, link4, Frame((0, 0, 0), (1, 0, 0), (0, 1, 0)), axis)
model.add_joint("joint5", Joint.CONTINUOUS, link5, link7, Frame((length_*0.5, 0, 0), (1, 0, 0), (0, 1, 0)), axis)
model.add_joint("joint6", Joint.FIXED, link5, link6, Frame((-length_*1.5, 0, 0), (1, 0, 0), (0, 1, 0)), axis)

model.add_joint("joint7", Joint.CONTINUOUS, link1, link8, frame, axis)
model.add_joint("joint8", Joint.CONTINUOUS, link2, link9, frame, axis)
model.add_joint("joint9", Joint.CONTINUOUS, link8, link10, frame, axis)
model.add_joint("joint10", Joint.CONTINUOUS, link9, link11, frame, axis)


j_names = [j.name for j in model.joints if j.type == 1]
# Create a configuration object matching the number of joints in your model
configuration = Configuration.from_revolute_values(config,j_names)

# Update the model using the artist
artist = Artist(model)
artist.update(configuration)

# Render everything
art = artist.draw_visual()
artist.redraw()
# ---------- end python ----------
