# Grasshopper definition 504_reachability_map.ghx (Grasshopper 1.0.7)

reload = Button()

# ----
# Robot
load = Button()
python = PythonScript(load=load)  # -> robot
# ---------- python: Python ----------
from scriptcontext import sticky as st

import compas

from compas_fab.robots.ur5 import Robot
from compas_ghpython.artists import RobotModelArtist

# Robot meshes are usually in meters
# Set a high precision to prevent parsing errors
# and configure Rhino itself in meters
compas.PRECISION = '12f'

# Store robot in component-based key
robot_key = 'robot_{}'.format(str(ghenv.Component.InstanceGuid))

if robot_key not in st:
    st[robot_key] = None

if load:
    robot = Robot(load_geometry=True)
    robot.artist = RobotModelArtist(robot.model)

    st[robot_key] = robot

robot = st[robot_key]
# ---------- end python ----------
robot = Data(python)

py = GhPythonScript()  # -> DATA
# ---------- py: Python ----------
import os

filename = ghenv.Component.OnPingDocument().FilePath

DATA = os.path.join(os.path.dirname(filename), "..", "data")
DATA = os.path.abspath(DATA)
# ---------- end py ----------

# ----
# Example 01: reachability map 1D
panel = Panel("map1D.json")
python_2 = GhPythonScript(folder=py, filename=panel)  # -> filepath
# ---------- python_2: Python ----------
import os

filepath = os.path.join(folder, filename)
# ---------- end python_2 ----------
map = GhPythonScript(filepath=python_2)  # -> map, best_score
# ---------- map: Python ----------
from compas_fab.robots.reachability_map import ReachabilityMap

map = ReachabilityMap.from_json(filepath)

best_score = map.best_score
# ---------- end map ----------
best_score = Panel(map.best_score)
number_slider = Slider(2, range=0..7)
value_list = ValueList({"plasma", "magma", "inferno", "viridis"}, selected="plasma")
artist = GhPythonScript(
    map=map.map,
    draw_frames=Toggle(False),
    draw_cloud=Toggle(False),
    colormap=value_list,
    draw_frames_at_ik_index=Toggle(False),
    ik_index=number_slider)  # -> frames, frames_ik_index, points, colors; inputs ik_index: Int32
# ---------- artist: Python ----------
from compas.artists import Artist

artist = Artist(map)

if draw_frames:
    frames = artist.draw_frames()

if draw_cloud:
    points, colors = artist.draw_cloud(colormap=colormap)

if draw_frames_at_ik_index:
    frames_ik_index = artist.draw_frames(ik_index=ik_index)
# ---------- end artist ----------
py_2 = GhPythonScript(map=map.map, ik_index=number_slider)  # -> configurations; inputs ik_index: Int32
# ---------- py_2: Python ----------
_, configurations = map.reachable_frames_and_configurations_at_ik_index(ik_index)
# ---------- end py_2 ----------
draw = GhPythonScript(frames=artist.frames, scale=Slider(0.01, range=0..0.1))  # -> P, V, C, W; inputs frames: list
# ---------- draw: Python ----------
from System.Drawing import Color
from compas_ghpython.utilities import draw_frame
from compas.geometry import Frame

red = Color.FromArgb(255, 0, 0)
green = Color.FromArgb(0, 255, 0)
blue = Color.FromArgb(0, 0, 255)

P = []
V = []
C = []

scale = float(scale)

for frame in frames:
    
    if not frame:
        continue
    if isinstance(frame, Frame):
        plane = draw_frame(frame)
    else:
        plane = frame
    P += [plane.Origin] * 3
    V.append(plane.XAxis * scale)
    V.append(plane.YAxis * scale)
    V.append(plane.ZAxis * scale)
    C += [red, green, blue]

W = 3
# ---------- end draw ----------
vdisex = VectorDisplayEx(Point=draw.P, Vector=draw.V, Colour=draw.C, Width=draw.W)
cloud = CloudDisplay(Points=artist.points, Colours=artist.colors, Size=Slider(0.01, range=0..0.1), SpriteType=1)
draw_2 = GhPythonScript(frames=artist.frames_ik_index, scale=Slider(0.01, range=0..0.1))  # -> P, V, C, W; inputs frames: list; same code as draw
vdisex_2 = VectorDisplayEx(Point=draw_2.P, Vector=draw_2.V, Colour=draw_2.C, Width=draw_2.W)

Z = UnitZ(Factor=0.1)
pt = Point(Point(1.352907467, 0, 0))
vdisex_3 = VectorDisplayEx(Point=pt, Vector=Z, Colour=ColourSwatch(SwatchColor=RGB(255, 0, 0)), Width=5)

# ----
# Example 02: reachability map 2D with deviation vectors
panel_2 = Panel("map2D_deviation.json")
python_3 = GhPythonScript(folder=py, filename=panel_2)  # -> filepath; same code as python_2
map_2 = GhPythonScript(filepath=python_3)  # -> map, best_score; same code as map
best_score_2 = Panel(map_2.best_score)
number_slider_2 = Slider(2, range=0..7)
value_list_2 = ValueList({"plasma", "magma", "inferno", "viridis"}, selected="viridis")
artist_2 = GhPythonScript(
    map=map_2.map,
    draw_frames=Toggle(False),
    draw_cloud=Toggle(False),
    colormap=value_list_2,
    draw_frames_at_ik_index=Toggle(False),
    ik_index=number_slider_2)  # -> frames, frames_ik_index, points, colors; inputs ik_index: Int32; same code as artist
py_3 = GhPythonScript(map=map_2.map, ik_index=number_slider_2)  # -> configurations; inputs ik_index: Int32; same code as py_2
draw_3 = GhPythonScript(frames=artist_2.frames, scale=Slider(0.01, range=0..0.1))  # -> P, V, C, W; inputs frames: list; same code as draw
vdisex_4 = VectorDisplayEx(Point=draw_3.P, Vector=draw_3.V, Colour=draw_3.C, Width=draw_3.W)
cloud_2 = CloudDisplay(Points=artist_2.points, Colours=artist_2.colors, Size=Slider(0.01, range=0..0.1), SpriteType=1)
draw_4 = GhPythonScript(frames=artist_2.frames_ik_index, scale=Slider(0.01, range=0..0.1))  # -> P, V, C, W; inputs frames: list; same code as draw
vdisex_5 = VectorDisplayEx(Point=draw_4.P, Vector=draw_4.V, Colour=draw_4.C, Width=draw_4.W)

# ----
# OrthonormalVectorsFromAxisGenerator
number_slider_3 = Slider(20, range=0..100)
python_4 = GhPythonScript(axis=Z, max_alpha=number_slider_3)  # -> vectors
# ---------- python_4: Python ----------
import math
from compas_fab.robots import OrthonormalVectorsFromAxisGenerator
import Rhino.Geometry as rg

vectors = []
 
for zaxis in OrthonormalVectorsFromAxisGenerator(axis, math.radians(max_alpha)):
    vectors.append(rg.Vector3d(*list(zaxis)) * axis.Length)
# ---------- end python_4 ----------
vdisex_6 = VectorDisplayEx(Point=pt, Vector=python_4, Colour=ColourSwatch(SwatchColor=RGB(0, 0, 0)), Width=2)

py_4 = PythonScript(reload=reload)
# ---------- py_4: Python ----------
if reload:
    from compas_ghpython import unload_modules
    unload_modules('compas')
    unload_modules('compas_fab')


import compas
import compas_fab
# ---------- end py_4 ----------

python_5 = GhPythonScript()  # -> centers, spheres
# ---------- python_5: Python ----------
from compas.geometry import Sphere
from compas.geometry import Vector
from compas.artists import Artist

def sphere_center_generator():
    sphere = Sphere((0.35, 0, 0), 0.15)
    for x in range(5):
        for z in range(7):
            center = sphere.point + Vector(x, 0, z) * 0.05
            yield center

centers = list(sphere_center_generator())

P = [Artist(c).draw() for c in centers]

import Rhino.Geometry as rg
spheres = [rg.Sphere(c, 0.15) for c in P]
# ---------- end python_5 ----------
preview = CustomPreview(Geometry=python_5.spheres, Material=ColourSwatch(SwatchColor=RGBA(158, 158, 158, 71)))

# ----
# Example 03: reachability map 2D with sphere points
panel_3 = Panel("map2D_spheres.json")
python_6 = GhPythonScript(folder=py, filename=panel_3)  # -> filepath; same code as python_2
map_3 = GhPythonScript(filepath=python_6)  # -> map, best_score; same code as map
best_score_3 = Panel(map_3.best_score)
number_slider_4 = Slider(3, range=0..7)
value_list_3 = ValueList({"plasma", "magma", "inferno", "viridis"}, selected="plasma")
py_5 = GhPythonScript(map=map_3.map, ik_index=number_slider_4)  # -> configurations; inputs ik_index: Int32; same code as py_2
artist_3 = GhPythonScript(
    map=map_3.map,
    draw_frames=Toggle(False),
    draw_cloud=Toggle(False),
    colormap=value_list_3,
    draw_frames_at_ik_index=Toggle(False),
    ik_index=number_slider_4,
    overwrite_points=Toggle(False),
    sphere_centers=python_5.centers)  # -> frames, frames_ik_index, points, colors; inputs ik_index: Int32, sphere_centers: list
# ---------- artist_3: Python ----------
from compas.artists import Artist

artist = Artist(map)

if draw_frames:
    frames = artist.draw_frames()

if draw_cloud:
    points, colors = artist.draw_cloud(colormap=colormap)

if draw_frames_at_ik_index:
    frames_ik_index = artist.draw_frames(ik_index=ik_index)

if overwrite_points:
    points, colors = artist.draw_cloud(points=sphere_centers, colormap=colormap)
# ---------- end artist_3 ----------
draw_5 = GhPythonScript(frames=artist_3.frames, scale=Slider(0.01, range=0..0.1))  # -> P, V, C, W; inputs frames: list; same code as draw
vdisex_7 = VectorDisplayEx(Point=draw_5.P, Vector=draw_5.V, Colour=draw_5.C, Width=draw_5.W)
cloud_3 = CloudDisplay(Points=artist_3.points, Colours=artist_3.colors, Size=Slider(0.01, range=0..0.1), SpriteType=1)
draw_6 = GhPythonScript(frames=artist_3.frames_ik_index, scale=Slider(0.01, range=0..0.1))  # -> P, V, C, W; inputs frames: list; same code as draw
vdisex_8 = VectorDisplayEx(Point=draw_6.P, Vector=draw_6.V, Colour=draw_6.C, Width=draw_6.W)

# ----
# Visualisation
number_slider_5 = Slider(0, range=0..100)
list = ValueList({"0", "1", "2"}, selected="0")
filter = StreamFilter(Gate=list, Stream0=py_2, Stream1=py_3, Stream2=py_5)
item = ListItem(List=filter, Index=number_slider_5, Wrap=True)
show_end_effector_frame = BooleanToggle(False)
show_base_frame = BooleanToggle(False)
show_collision = BooleanToggle(False)
show_frames = BooleanToggle(False)
show_visual = BooleanToggle(True)
robot_visualize = RobotVisualize(
    robot=robot,
    configuration=item,
    show_visual=show_visual,
    show_collision=show_collision,
    show_frames=show_frames,
    show_base_frame=show_base_frame,
    show_end_effector_frame=show_end_effector_frame)  # -> visual, collision, attached_meshes, frames, base_frame, ee_frame; inputs attached_collision_meshes: list, show_visual: Boolean, show_collision: Boolean, show_frames: Boolean, show_base_frame: Boolean, show_end_effector_frame: Boolean, show_acm: Boolean; disabled
#   port group: The planning group used for end-effector and base visualization.
#   port configuration: The robot's full configuration.
#   port attached_collision_meshes: A list of attached collision meshes.
#   port show_visual: Whether or not to show the robot's visual meshes.
#   port show_collision: Whether or not to show the robot's collision meshes.
#   port show_frames: Whether or not to show the robot's joint frames.
#   port show_base_frame: Whether or not to show the robot's base frame.
#   port show_end_effector_frame: Whether or not to show the robot's end-effector frame.
#   port show_acm: Whether or not to show the attached collision meshes (if any).
#   port visual: The robot's visual Rhino meshes (if any).
#   port collision: The robot's collision Rhino meshes (if any).
#   port attached_meshes: The attached collision Rhino meshes (if any).
#   port frames: The robot's joint frames as Rhino planes (if any).
#   port base_frame: The robot's base frame as a Rhino plane (if any).
#   port ee_frame: The robot's end-effector frame as a Rhino plane (if any).
# ---------- robot_visualize: Python ----------
"""
Visualizes the robot.

COMPAS FAB v0.22.0
"""
from compas.geometry import Frame
from compas.geometry import Transformation
from compas_ghpython.artists import FrameArtist
from compas_ghpython.artists import MeshArtist
from ghpythonlib.componentbase import executingcomponent as component


class RobotVisualize(component):
    def RunScript(self, robot, group, configuration, attached_collision_meshes, show_visual, show_collision,
                  show_frames, show_base_frame, show_end_effector_frame, show_acm):

        visual = None
        collision = None
        attached_meshes = None
        frames = None
        base_frame = None
        ee_frame = None

        if robot:
            show_visual = True if show_visual is None else show_visual
            configuration = configuration or robot.zero_configuration()

            robot.update(configuration, visual=show_visual, collision=show_collision)
            compas_frames = robot.transformed_frames(configuration, group)

            if show_visual:
                visual = robot.artist.draw_visual()

            if show_collision:
                collision = robot.artist.draw_collision()

            if show_base_frame:
                base_compas_frame = compas_frames[0]
                artist = FrameArtist(base_compas_frame)
                base_frame = artist.draw()

            if show_end_effector_frame:
                ee_compas_frame = robot.forward_kinematics(configuration, group, options=dict(solver='model'))
                artist = FrameArtist(ee_compas_frame)
                ee_frame = artist.draw()

            if show_frames:
                frames = []
                for compas_frame in compas_frames[1:]:
                    artist = FrameArtist(compas_frame)
                    frame = artist.draw()
                    frames.append(frame)

            if show_acm:
                attached_meshes = []
                for acm in attached_collision_meshes:
                    frame = robot.forward_kinematics(configuration, options=dict(solver='model', link_name=acm.link_name))
                    T = Transformation.from_frame_to_frame(Frame.worldXY(), frame)
                    mesh = acm.collision_mesh.mesh.transformed(T)
                    attached_meshes.append(MeshArtist(mesh).draw())

        return (visual, collision, attached_meshes, frames, base_frame, ee_frame)
# ---------- end robot_visualize ----------
draw_7 = GhPythonScript(frames=[robot_visualize.frames, robot_visualize.base_frame, robot_visualize.ee_frame], scale=Slider(0.1, range=0..1))  # -> P, V, C, W; inputs frames: list; same code as draw
geo = Geometry(robot_visualize.collision)
geo_2 = Geometry(robot_visualize.visual)
vdisex_9 = VectorDisplayEx(Point=draw_7.P, Vector=draw_7.V, Colour=draw_7.C, Width=draw_7.W)

# ----
# DeviationVectorsGenerator
number_slider_6 = Slider(47, range=0..100)
python_7 = GhPythonScript(axis=Z, max_alpha=number_slider_6, step=Slider(1, range=0..10))  # -> vectors; inputs step: Int32
# ---------- python_7: Python ----------
import math
from compas_fab.robots.reachability_map import DeviationVectorsGenerator
import Rhino.Geometry as rg 

vectors = []

for zaxis in DeviationVectorsGenerator(axis, math.radians(max_alpha), int(step)):
    vectors.append(rg.Vector3d(*list(zaxis)))
# ---------- end python_7 ----------
vdisex_10 = VectorDisplayEx(Point=pt, Vector=python_7, Colour=ColourSwatch(SwatchColor=RGB(0, 0, 0)), Width=2)
