# Grasshopper definition reachability_map.ghx (Grasshopper 1.0.7)

reload = Button()

# ----
# Robot
load = Button()
python = PythonScript(load=load)  # -> robot
# ---------- python: Python ----------
from scriptcontext import sticky as st

import compas

from compas_fab.robots.ur5 import Robot
from compas_ghpython.artists import RobotModelArtist

# Robot meshes are usually in meters
# Set a high precision to prevent parsing errors
# and configure Rhino itself in meters
compas.PRECISION = '12f'

# Store robot in component-based key
robot_key = 'robot_{}'.format(str(ghenv.Component.InstanceGuid))

if robot_key not in st:
    st[robot_key] = None

if load:
    robot = Robot(load_geometry=True)
    robot.artist = RobotModelArtist(robot.model)

    st[robot_key] = robot

robot = st[robot_key]
# ---------- end python ----------
robot = Data(python)

vec = Vector()
py = PythonScript(reload=reload)
# ---------- py: Python ----------
if reload:
    from compas_ghpython import unload_modules
    unload_modules('compas')
    unload_modules('compas_fab')
# ---------- end py ----------
py_2 = GhPythonScript()  # -> DATA; unedited script template
py_3 = GhPythonScript()  # -> DATA; unedited script template
py_4 = GhPythonScript()  # -> DATA; unedited script template
pt = Point(Point(0.35, 0, 0))

# ---- group: forward kinematics
# Configuration
a1 = Slider(0, range=-360..360)
a2 = Slider(0, range=-360..360)
a3 = Slider(0, range=-360..360)
a4 = Slider(0, range=-360..360)
a5 = Slider(0, range=-360..360)
a6 = Slider(0, range=-360..360)
forward_kinematics = PythonScript(robot=robot, a1=a1, a2=a2, a3=a3, a4=a4, a5=a5, a6=a6)  # -> configuration
# ---------- forward_kinematics: Python ----------
import math
from compas.robots import Configuration

if robot:
    joint_values = [a1, a2, a3, a4, a5, a6]
    joint_names = robot.get_configurable_joint_names()
    configuration = Configuration.from_revolute_values([math.radians(a) for a in joint_values])
# ---------- end forward_kinematics ----------

# ----
python_2 = GhPythonScript(folder=py_4, filename="reachability\map2D_deviation.json")  # -> filepath
# ---------- python_2: Python ----------
import os

filepath = os.path.join(folder, filename)
# ---------- end python_2 ----------
python_3 = GhPythonScript(folder=py_2, filename="reachability\map1D.json")  # -> filepath; same code as python_2
python_4 = GhPythonScript(folder=py_3, filename="reachability\map2D_spheres.json")  # -> filepath; same code as python_2
python_5 = GhPythonScript()  # -> out, sphere_centers, a
# ---------- python_5: Python ----------
from compas.geometry import *

import Rhino.Geometry as rg

def sphere_generator():
    sphere = Sphere((0.35, 0, 0), 0.15)
    for x in range(5):
        for z in range(7):
            center = sphere.point + Vector(x, 0, z) * 0.05
            yield Sphere(center, sphere.radius)

spheres = [s for s in sphere_generator()]

sphere_centers = [s.point for s in spheres]

from compas.artists import ShapeArtist

a = [rg.Sphere(rg.Point3d(*list(s.point)), s.radius) for s in spheres]

#a = [ShapeArtist(s).draw() for s in spheres]
# ---------- end python_5 ----------
python_6 = GhPythonScript(point=pt)  # -> out, a; disabled
# ---------- python_6: Python ----------
from compas.geometry import Vector, Point
from compas.artists import PrimitiveArtist

points = []

point = Point(*list(point))

step = 0.05
for x in range(5):
    for z in range(7):
        pt = point + Vector(x, 0, z) * step
        points.append(pt)


a = [PrimitiveArtist(pt).draw() for pt in points]
# ---------- end python_6 ----------
rm = GhPythonScript(filepath=python_2)  # -> map
# ---------- rm: Python ----------
from compas_fab.robots.reachability_map import ReachabilityMap

map = ReachabilityMap.from_json(filepath)
# ---------- end rm ----------
rm_2 = GhPythonScript(filepath=python_3)  # -> map; same code as rm
rm_3 = GhPythonScript(filepath=python_4)  # -> map; same code as rm
python_7 = GhPythonScript(point=pt, radius=Slider(0.15, range=0..1))  # -> out, sphere, a, b
# ---------- python_7: Python ----------
from compas.geometry import Sphere
from compas.artists import ShapeArtist

print point, radius

sphere = Sphere(point, radius)

a = ShapeArtist(sphere).draw()
# ---------- end python_7 ----------
number_slider = Slider(2, range=0..10)
number_slider_2 = Slider(2, range=0..10)
number_slider_3 = Slider(2, range=0..10)
swatch = ColourSwatch(SwatchColor=RGBA(158, 158, 158, 71))
pt_2 = Point(Point(0, 0, 0))  # disabled
item = ListItem(List=python_5.a, Index=20, Wrap=True)
python_8 = GhPythonScript(
    map=rm,
    draw_frames=Toggle(False),
    draw_cloud=Toggle(False),
    draw_frames_at_ik_index=Toggle(False),
    ik_index=number_slider)  # -> frames, frames_index, points, colors; inputs ik_index: Int32
# ---------- python_8: Python ----------
from compas_fab.ghpython.reachability_artist import ReachabilityMapArtist



artist = ReachabilityMapArtist(map)

print map.score

print map.best_score

print min(map.score)

if draw_frames:
    frames = artist.draw_frames()

print len(map.points)
print map.points[0]

if draw_cloud:
    #points, colors = artist.draw_cloud(colormap='plasma')
    points, colors = artist.draw_cloud(colormap='viridis')

if draw_frames_at_ik_index:
    frames_index = artist.draw_frames_at_ik_index(ik_index)
# ---------- end python_8 ----------
Z = UnitZ(Factor=1)  # disabled
python_9 = GhPythonScript(
    map=rm_2,
    draw_frames=Toggle(False),
    draw_cloud=Toggle(False),
    draw_frames_at_ik_index=Toggle(False),
    ik_index=number_slider_2)  # -> frames, frames_index, points, colors; inputs ik_index: Int32
# ---------- python_9: Python ----------
from compas_fab.ghpython.reachability_artist import ReachabilityMapArtist



artist = ReachabilityMapArtist(map)

print map.score
print min(map.score), max(map.score)

if draw_frames:
    frames = artist.draw_frames()


if draw_cloud:
    points, colors = artist.draw_cloud()

if draw_frames_at_ik_index:
    frames_index = artist.draw_frames_at_ik_index(ik_index)
# ---------- end python_9 ----------
panel = Panel("iterate through configurations?")
python_10 = GhPythonScript(
    map=rm_3,
    draw_frames=Toggle(False),
    draw_cloud=Toggle(True),
    draw_frames_at_ik_index=Toggle(False),
    ik_index=number_slider_3,
    points=python_5.sphere_centers,
    override_points=Toggle(True))  # -> frames, frames_index, points, colors, best_point, a, b; inputs ik_index: Int32, points: list
# ---------- python_10: Python ----------
from compas.artists import PrimitiveArtist
from compas_fab.ghpython.reachability_artist import ReachabilityMapArtist



artist = ReachabilityMapArtist(map)

print map.shape

print map.score

print min(map.score)
print map.best_score

if draw_frames:
    frames = artist.draw_frames()


if draw_cloud:
    if override_points:
        points, colors = artist.draw_cloud(colormap='plasma', points=points)
    else:
        points, colors = artist.draw_cloud(colormap='plasma')
else:
    points = None

if draw_frames_at_ik_index:
    frames_index = artist.draw_frames_at_ik_index(ik_index)
    

import Rhino.Geometry as rg
best_point = map.points[map.best_score[1]]
best_point = rg.Point3d(*list(best_point))
# ---------- end python_10 ----------
python_11 = GhPythonScript(sphere=python_7.sphere, num=Slider(200, range=0..1000))  # -> frames, a; inputs num: Int32
# ---------- python_11: Python ----------
import math
from compas.geometry import Point
from compas.geometry import Plane, Frame
from compas.artists import PrimitiveArtist
from compas.artists import PrimitiveArtist


# points_from_sphere

planes = []
frames = []
for theta_deg in range(0, 360, 20):
    for phi_deg in range(0, 90, 10):
        theta = math.radians(theta_deg)
        phi = math.radians(phi_deg)
        x = sphere.point.x + sphere.radius * math.cos(theta) * math.sin(phi)
        y = sphere.point.y + sphere.radius * math.sin(theta) * math.sin(phi)
        z = sphere.point.z + sphere.radius * math.cos(phi)
        point= Point(x, y, z)
        axis = sphere.point - point
        plane = Plane((x, y, z), axis)
        f = Frame.from_plane(plane)
        frames.append(Frame(f.point, f.zaxis, f.yaxis))



a = [PrimitiveArtist(pt).draw() for pt in frames]
# ---------- end python_11 ----------
python_12 = GhPythonScript(map=rm, ik_index=number_slider)  # -> out, configurations; inputs ik_index: Int32
# ---------- python_12: Python ----------
_, configurations = map.reachable_frames_and_configurations_at_ik_index(ik_index)
# ---------- end python_12 ----------
python_13 = GhPythonScript(map=rm_2, ik_index=number_slider_2)  # -> out, configurations; inputs ik_index: Int32; same code as python_12
item_2 = ListItem(List=python_13.configurations, Index=Slider(0, range=0..100), Wrap=True)

# ----
# Visualisation
show_end_effector_frame = BooleanToggle(False)
show_base_frame = BooleanToggle(False)
show_collision = BooleanToggle(False)
show_frames = BooleanToggle(False)
show_visual = BooleanToggle(True)
robot_visualize = RobotVisualize(
    robot=robot,
    configuration=item_2,
    show_visual=show_visual,
    show_collision=show_collision,
    show_frames=show_frames,
    show_base_frame=show_base_frame,
    show_end_effector_frame=show_end_effector_frame)  # -> visual, collision, attached_meshes, frames, base_frame, ee_frame; inputs attached_collision_meshes: list, show_visual: Boolean, show_collision: Boolean, show_frames: Boolean, show_base_frame: Boolean, show_end_effector_frame: Boolean, show_acm: Boolean
#   port group: The planning group used for end-effector and base visualization.
#   port configuration: The robot's full configuration.
#   port attached_collision_meshes: A list of attached collision meshes.
#   port show_visual: Whether or not to show the robot's visual meshes.
#   port show_collision: Whether or not to show the robot's collision meshes.
#   port show_frames: Whether or not to show the robot's joint frames.
#   port show_base_frame: Whether or not to show the robot's base frame.
#   port show_end_effector_frame: Whether or not to show the robot's end-effector frame.
#   port show_acm: Whether or not to show the attached collision meshes (if any).
#   port visual: The robot's visual Rhino meshes (if any).
#   port collision: The robot's collision Rhino meshes (if any).
#   port attached_meshes: The attached collision Rhino meshes (if any).
#   port frames: The robot's joint frames as Rhino planes (if any).
#   port base_frame: The robot's base frame as a Rhino plane (if any).
#   port ee_frame: The robot's end-effector frame as a Rhino plane (if any).
# ---------- robot_visualize: Python ----------
"""
Visualizes the robot.

COMPAS FAB v0.22.0
"""
from compas.geometry import Frame
from compas.geometry import Transformation
from compas_ghpython.artists import FrameArtist
from compas_ghpython.artists import MeshArtist
from ghpythonlib.componentbase import executingcomponent as component


class RobotVisualize(component):
    def RunScript(self, robot, group, configuration, attached_collision_meshes, show_visual, show_collision,
                  show_frames, show_base_frame, show_end_effector_frame, show_acm):

        visual = None
        collision = None
        attached_meshes = None
        frames = None
        base_frame = None
        ee_frame = None

        if robot:
            show_visual = True if show_visual is None else show_visual
            configuration = configuration or robot.zero_configuration()

            robot.update(configuration, visual=show_visual, collision=show_collision)
            compas_frames = robot.transformed_frames(configuration, group)

            if show_visual:
                visual = robot.artist.draw_visual()

            if show_collision:
                collision = robot.artist.draw_collision()

            if show_base_frame:
                base_compas_frame = compas_frames[0]
                artist = FrameArtist(base_compas_frame)
                base_frame = artist.draw()

            if show_end_effector_frame:
                ee_compas_frame = robot.forward_kinematics(configuration, group, options=dict(solver='model'))
                artist = FrameArtist(ee_compas_frame)
                ee_frame = artist.draw()

            if show_frames:
                frames = []
                for compas_frame in compas_frames[1:]:
                    artist = FrameArtist(compas_frame)
                    frame = artist.draw()
                    frames.append(frame)

            if show_acm:
                attached_meshes = []
                for acm in attached_collision_meshes:
                    frame = robot.forward_kinematics(configuration, options=dict(solver='model', link_name=acm.link_name))
                    T = Transformation.from_frame_to_frame(Frame.worldXY(), frame)
                    mesh = acm.collision_mesh.mesh.transformed(T)
                    attached_meshes.append(MeshArtist(mesh).draw())

        return (visual, collision, attached_meshes, frames, base_frame, ee_frame)
# ---------- end robot_visualize ----------
number_slider_4 = Slider(0.1, range=0..1)
draw = GhPythonScript(frames=[robot_visualize.frames, robot_visualize.base_frame, robot_visualize.ee_frame], scale=number_slider_4)  # -> P, V, C, W; inputs frames: list
# ---------- draw: Python ----------
from System.Drawing import Color
from compas_ghpython.utilities import draw_frame
from compas.geometry import Frame

red = Color.FromArgb(255, 0, 0)
green = Color.FromArgb(0, 255, 0)
blue = Color.FromArgb(0, 0, 255)

P = []
V = []
C = []

scale = float(scale)

for frame in frames:
    
    if not frame:
        continue
    if isinstance(frame, Frame):
        plane = draw_frame(frame)
    else:
        plane = frame
    P += [plane.Origin] * 3
    V.append(plane.XAxis * scale)
    V.append(plane.YAxis * scale)
    V.append(plane.ZAxis * scale)
    C += [red, green, blue]

W = 3
# ---------- end draw ----------
geo = Geometry(robot_visualize.collision)
geo_2 = Geometry(robot_visualize.visual)
vdisex = VectorDisplayEx(Point=draw.P, Vector=draw.V, Colour=draw.C, Width=draw.W)

python_14 = GhPythonScript(map=rm_3, ik_index=number_slider_3)  # -> out, configurations; inputs ik_index: Int32; same code as python_12
preview = CustomPreview(Geometry=python_5.a, Material=swatch)
number_slider_5 = Slider(60, range=0..100)  # disabled
preview_2 = CustomPreview(Geometry=item, Material=swatch)
draw_2 = GhPythonScript(frames=python_11.frames, scale=Slider(0.01, range=0..0.1))  # -> P, V, C, W; inputs frames: list; same code as draw
swatch_2 = ColourSwatch(SwatchColor=RGB(255, 0, 0))  # disabled
pt_3 = Point(python_8.frames_index)
pt_4 = Point(python_9.frames_index)
pt_5 = Point(python_10.frames_index)
python_15 = GhPythonScript(axis=Z, max_alpha=number_slider_5)  # -> out, vectors; disabled
# ---------- python_15: Python ----------
import math
from compas_fab.robots.reachability_map import OrthonormalVectorsFromAxisGenerator
import Rhino.Geometry as rg 
from compas.geometry import Vector

vectors = []

for zaxis in OrthonormalVectorsFromAxisGenerator(axis, math.radians(max_alpha)):
    print zaxis
    vectors.append(rg.Vector3d(*list(zaxis)))

print("==========")

zaxis = Vector(0, 0, 1)
max_alpha = 60
for xaxis in OrthonormalVectorsFromAxisGenerator(zaxis, math.radians(max_alpha)):
    print(xaxis)
# ---------- end python_15 ----------
vdisex_2 = VectorDisplayEx(Point=draw_2.P, Vector=draw_2.V, Colour=draw_2.C, Width=draw_2.W)
draw_3 = GhPythonScript(frames=python_8.frames, scale=Slider(0.01, range=0..0.1))  # -> P, V, C, W; inputs frames: list; same code as draw
draw_4 = GhPythonScript(frames=python_10.frames, scale=Slider(0.01, range=0..0.1))  # -> P, V, C, W; inputs frames: list; same code as draw
vdisex_3 = VectorDisplayEx(Point=pt_2, Vector=Z, Colour=swatch_2, Width=5)  # disabled
draw_5 = GhPythonScript(frames=python_9.frames, scale=Slider(0.01, range=0..0.1))  # -> P, V, C, W; inputs frames: list; same code as draw
cloud = CloudDisplay(Points=python_10.points, Colours=python_10.colors, Size=Slider(0.01, range=0..0.01), SpriteType=1)
python_16 = GhPythonScript()  # -> out, a
# ---------- python_16: Python ----------
from compas.geometry import Vector, Point, Frame
from compas_fab.robots.reachability_map import DeviationVectorsGenerator
from compas_fab.robots.reachability_map import OrthonormalVectorsFromAxisGenerator
import math
from compas.artists import PrimitiveArtist

def frame_generator():
    for i in range(6):
        pt = Point(0, 0, 0) + Vector(0, i, 0)
        zaxis = Vector(0, 0, 1)
        for axis in DeviationVectorsGenerator(zaxis, math.radians(40), 1):
            for xaxis in OrthonormalVectorsFromAxisGenerator(axis, math.radians(60)):
                yaxis = axis.cross(xaxis)
                yield Frame(pt, xaxis, yaxis)


a = [PrimitiveArtist(f).draw() for f in frame_generator()]
# ---------- end python_16 ----------
cloud_2 = CloudDisplay(Points=python_8.points, Colours=python_8.colors, Size=Slider(0.01, range=0..0.01), SpriteType=1)
cloud_3 = CloudDisplay(Points=python_9.points, Colours=python_9.colors, Size=Slider(0.01, range=0..0.1), SpriteType=1)
vdisex_4 = VectorDisplayEx(Point=draw_3.P, Vector=draw_3.V, Colour=draw_3.C, Width=draw_3.W)
pt_6 = Point(python_10.best_point)
vdisex_5 = VectorDisplayEx(Point=draw_4.P, Vector=draw_4.V, Colour=draw_4.C, Width=draw_4.W)
swatch_3 = ColourSwatch(SwatchColor=RGB(0, 0, 0))  # disabled
vdisex_6 = VectorDisplayEx(Point=draw_5.P, Vector=draw_5.V, Colour=draw_5.C, Width=draw_5.W)
draw_6 = GhPythonScript(frames=python_16.a, scale=Slider(0, range=0..1))  # -> P, V, C, W; inputs frames: list; same code as draw
number_slider_6 = Slider(0.1, range=0..0.1)
draw_7 = GhPythonScript(frames=python_9.frames_index, scale=Slider(0.01, range=0..0.1))  # -> P, V, C, W; inputs frames: list; same code as draw
vdisex_7 = VectorDisplayEx(Point=pt_2, Vector=python_15.vectors, Colour=swatch_3, Width=2)  # disabled
vdisex_8 = VectorDisplayEx(Point=draw_6.P, Vector=draw_6.V, Colour=draw_6.C, Width=draw_6.W)
vdisex_9 = VectorDisplayEx(Point=draw_7.P, Vector=draw_7.V, Colour=draw_7.C, Width=draw_7.W)
pt_7 = Point(pt_2)  # disabled
number_slider_7 = Slider(40, range=0..100)  # disabled
number_slider_8 = Slider(1, range=0..10)  # disabled
py_5 = GhPythonScript()  # -> DATA; unedited script template
pt_8 = Point(Point(0.4667804797, 1.470603145, 0))
pt_9 = Point(Point(1.25068974, 2.149468062, 1.139083964))
swatch_4 = ColourSwatch(SwatchColor=RGB(255, 0, 0))  # disabled
vec2pt = Vector2Pt(PointA=pt_9, PointB=pt_8, Unitize=True)  # -> Vector, Length
python_17 = GhPythonScript(axis=Z, max_alpha=number_slider_7, step=number_slider_8)  # -> out, vectors; inputs step: Int32; disabled
# ---------- python_17: Python ----------
import math
from compas_fab.robots.reachability_map import DeviationVectorsGenerator
import Rhino.Geometry as rg 

vectors = []

for zaxis in DeviationVectorsGenerator(axis, math.radians(max_alpha), int(step)):
    print zaxis
    vectors.append(rg.Vector3d(*list(zaxis)))

from compas.geometry import Vector

print "==========="

zaxis = Vector(0, 0, 1)
max_alpha = 40
step = 1
for axis in DeviationVectorsGenerator(zaxis, math.radians(max_alpha), step):
    print(axis)
# ---------- end python_17 ----------
python_18 = GhPythonScript(folder=py_5, filename="reachability\map3D.json")  # -> filepath; same code as python_2
vdisex_10 = VectorDisplayEx(Point=pt_7, Vector=Z, Colour=swatch_4, Width=5)  # disabled
panel_2 = Panel(python_18)
python_19 = GhPythonScript()  # -> Out, A
python_20 = GhPythonScript(axis=vec2pt.Vector, max_alpha=Slider(40, range=0..100), step=Slider(1, range=0..10))  # -> out, vectors; inputs step: Int32
# ---------- python_20: Python ----------
import math
from compas_fab.robots.reachability_map.frame_generator import DeviationVectorsGenerator
import Rhino.Geometry as rg 

vectors = []

for zaxis in DeviationVectorsGenerator(axis, math.radians(max_alpha), int(step)):
    print zaxis
    vectors.append(rg.Vector3d(*list(zaxis)))
# ---------- end python_20 ----------
swatch_5 = ColourSwatch(SwatchColor=RGB(0, 0, 0))  # disabled
vdisex_11 = VectorDisplayEx(Point=pt_9, Vector=vec2pt.Vector, Colour=ColourSwatch(SwatchColor=RGB(255, 0, 0)), Width=5)
rm_4 = GhPythonScript(filepath=python_18)  # -> map; same code as rm
vdis = VectorDisplay(Anchor=pt_7, Vector=python_17.vectors)  # disabled
number_slider_9 = Slider(2, range=0..10)
vdisex_12 = VectorDisplayEx(Point=pt_7, Vector=python_17.vectors, Colour=swatch_5, Width=2)  # disabled
vdis_2 = VectorDisplay(Anchor=pt_9, Vector=python_20.vectors)
vdisex_13 = VectorDisplayEx(Point=pt_9, Vector=python_20.vectors, Colour=ColourSwatch(SwatchColor=RGB(0, 0, 0)), Width=1)
python_21 = GhPythonScript(
    map=rm_4,
    draw_frames=Toggle(False),
    draw_cloud=Toggle(False),
    draw_frames_at_ik_index=Toggle(False),
    ik_index=number_slider_9)  # -> frames, frames_index, points, colors; inputs ik_index: Int32
# ---------- python_21: Python ----------
from compas_fab.ghpython.reachability_artist import ReachabilityMapArtist



artist = ReachabilityMapArtist(map)

print map.score

if draw_frames:
    frames = artist.draw_frames()


if draw_cloud:
    points, colors = artist.draw_cloud()

if draw_frames_at_ik_index:
    frames_index = artist.draw_frames_at_ik_index(ik_index)
# ---------- end python_21 ----------
python_22 = GhPythonScript(map=rm_4, ik_index=number_slider_9)  # -> out, configurations; inputs ik_index: Int32; same code as python_12
pt_10 = Point(python_21.frames_index)
draw_8 = GhPythonScript(frames=python_21.frames, scale=number_slider_4)  # -> P, V, C, W; inputs frames: list; same code as draw
cloud_4 = CloudDisplay(Points=python_21.points, Colours=python_21.colors, Size=Slider(0.02, range=0..0.1), SpriteType=0)
vdisex_14 = VectorDisplayEx(Point=draw_8.P, Vector=draw_8.V, Colour=draw_8.C, Width=draw_8.W)
