# Grasshopper definition 605_designer_viewer.ghx (Grasshopper 1.0.7)

height = Slider(0.02, range=0.02..0.1)
part = GhPythonScript(width=Slider(0.06, range=0.02..0.1), depth=Slider(0.03, range=0.02..0.1), height=height)  # -> a, part
# ---------- part: Python ----------
from compas.geometry import Box
from compas.artists import Artist

part = Box.from_diagonal([(width / -2., depth / -2., 0), (width / 2., depth / 2., height)])
a = Artist(part).draw()
# ---------- end part ----------
crv = Curve(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)
divide = DivideCurve(Curve=crv, Count=Slider(3, range=0..10), Kinks=False)  # -> Points, Tangents, Parameters
pt = Point(divide.Points)
assembly = GhPythonScript(points=pt, rows=Slider(5, range=1..20), part_shape=part.part)  # -> frames, curve, bricks, wall; inputs points: list
# ---------- assembly: Python ----------
from compas.artists import Artist
from compas.datastructures import Assembly
from compas.datastructures import Part
from compas.geometry import Box
from compas.geometry import Polyhedron
from compas.geometry import Frame
from compas.geometry import Transformation
from compas.geometry import Translation
from compas.geometry import NurbsCurve
from compas_rhino.conversions import RhinoPoint

# Create Wall as Assembly instance
wall = Assembly("exercise-wall")

# Create wall curve
points = [RhinoPoint.from_guid(p).to_compas() for p in points]
curve = NurbsCurve.from_interpolation(points)

HGAP = 0.005
VGAP = 0.002
divisions = curve.divide_by_length(part_shape.width + HGAP)

# Create brick frames
frames = []
key = 0
for row in range(int(rows)):
    Trow = Translation.from_vector((0, 0, part_shape.height / 2. + (part_shape.height + VGAP) * row))

    for div, i in zip(divisions, range(len(divisions))):
        point = curve.point_at(div)
        xaxis = curve.tangent_at(div)
        yaxis = xaxis.cross((0, 0, 1))
        frame = Frame(point, xaxis, yaxis)

        # Create bricks as parts
        width, height, depth = part_shape.width, part_shape.height, part_shape.depth
        brick_type = 'half'
        if row % 2 == 1 and i % len(divisions) == 0:
            brick_type = 'half'
        if row % 2 == 0 and i % (len(divisions)) == len(divisions)-1:
            brick_type = 'half'

        if brick_type == 'half':
            width = width / 2.
            xoffset = width / 2.
        else:
            xoffset = width / 2. if row % 2 == 0 else 0

        shape = Box.from_width_height_depth(width, height, depth)
        shape = Polyhedron(*shape.to_vertices_and_faces())

        Tb = Translation.from_vector((xoffset, 0, 0))
        Tf = Transformation.from_frame(frame)
        frame = Frame.from_transformation(Trow * Tf * Tb)
        frames.append(frame)

        part = Part(frame=frame, shape=shape)
        wall.add_part(part, key=str(key))
        key += 1


frames = [Artist(f).draw() for f in frames]
curve = Artist(curve).draw()
bricks = [Artist(brick.geometry).draw() for brick in wall.parts()]
# ---------- end assembly ----------
geo = Geometry(assembly.frames)
geo_2 = Geometry(assembly.bricks)
geo_3 = Geometry(assembly.curve)
path = FilePath("C:\COMPAS-II-FS2022\lecture_07\601_assembly_design.json")
to_json = ToJSON(data=assembly.wall, filepath=path, pretty=Toggle(True))  # -> json; inputs pretty: Boolean
#   port data: COMPAS data objects to serialize.
#   port filepath: File path where to store the JSON file. If empty, it will not store to disk but instead return the JSON string.
#   port pretty: If True, JSON data will be formatted with indentation and key sorting.
#   port json: JSON file path or JSON string.
# ---------- to_json: Python ----------
"""
Serializes COMPAS objects to JSON.
"""
from ghpythonlib.componentbase import executingcomponent as component

import compas


class CompasInfo(component):
    def RunScript(self, data, filepath, pretty):
        json = filepath

        if filepath:
            compas.json_dump(data, filepath, pretty)
        else:
            json = compas.json_dumps(data, pretty)

        return json
# ---------- end to_json ----------

# ---- group: Sequence generator
path_2 = FilePath("C:\COMPAS-II-FS2022\lecture_07\602_assembly_sequenced.json")
python = GhPythonScript(filename=to_json, filepath=path_2)  # -> out, json
# ---------- python: Python ----------
import compas
from compas.utilities import pairwise


# Load assembly
assembly = compas.json_load(filename)

# Define connectivity as a linear sequence of integers
linear_sequence = sorted(assembly.parts(), key=lambda p: int(p.key))
for a, b in pairwise(linear_sequence):
    assembly.add_connection(a, b)

print([part.key for part in linear_sequence])

# Save assembly
json = filepath
compas.json_dump(assembly, filepath, pretty=True)
# ---------- end python ----------

# ----
connect = BooleanToggle(True)
ros = ROSConnect(connect=connect)  # -> ros_client, is_connected; inputs port: Int32, connect: Boolean
#   port ip: The ip address ROS. Defaults to 127.0.0.1.
#   port port: The port of ROS. Defaults to 9090.
#   port connect: If True, connects to ROS. If False, disconnects from ROS. Defaults to False.
#   port ros_client: The ROS client.
#   port is_connected: True if connection established.
# ---------- ros: Python ----------
"""
Connect or disconnect to ROS.

COMPAS FAB v0.22.0
"""
from ghpythonlib.componentbase import executingcomponent as component
from scriptcontext import sticky as st

from compas_fab.backends import RosClient
from compas_fab.ghpython.components import create_id


class ROSConnect(component):
    def RunScript(self, ip, port, connect):
        ros_client = None

        ip = ip or '127.0.0.1'
        port = port or 9090

        key = create_id(self, 'ros_client')
        ros_client = st.get(key, None)

        if ros_client:
            st[key].close()
        if connect:
            st[key] = RosClient(ip, port)
            st[key].run(5)

        ros_client = st.get(key, None)
        is_connected = ros_client.is_connected if ros_client else False
        return (ros_client, is_connected)
# ---------- end ros ----------
load_robot = BooleanToggle(True)
robot = ROSRobot(ros_client=ros.ros_client, load=load_robot)  # -> robot; inputs load: Boolean
#   port ros_client: The ROS client.
#   port load: If True, loads the robot from ROS. Defaults to False.
# ---------- robot: Python ----------
"""
Load robot directly from ROS.

COMPAS FAB v0.22.0
"""
from compas_ghpython.artists import RobotModelArtist
from ghpythonlib.componentbase import executingcomponent as component
from scriptcontext import sticky as st

from compas_fab.ghpython.components import create_id


class ROSRobot(component):
    def RunScript(self, ros_client, load):
        key = create_id(self, 'robot')

        if ros_client and ros_client.is_connected and load:
            # Load URDF from ROS
            st[key] = ros_client.load_robot(load_geometry=True, precision='12f')
            st[key].artist = RobotModelArtist(st[key].model)

        robot = st.get(key, None)
        if robot:  # client sometimes need to be restarted, without needing to reload geometry
            robot.client = ros_client
        return robot
# ---------- end robot ----------

path_3 = FilePath("C:\COMPAS-II-FS2022\lecture_07\603_assembly_planning.json")
number_slider = Slider(4, range=0..100)
load = GhPythonScript(filename=path_3, robot=robot, reload=Button())  # -> robot, assembly
# ---------- load: Python ----------
import compas
from compas_fab.robots import Tool

assembly = compas.json_load(filename)
if 'tool' in assembly.attributes:
    tool = Tool.from_data(assembly.attributes['tool'])
    robot.attach_tool(tool)
# ---------- end load ----------
load_plans = GhPythonScript(assembly=load.assembly, part=number_slider, i=Slider(0, range=0..100))  # -> total, config, acms
# ---------- load_plans: Python ----------
trajectory_keys = ("start_trajectory",
                   "pick_trajectory",
                   "pick_trajectory_after",
                   "freespace_trajectory",
                   "place_trajectory",
                   "place_trajectory_after",)

# NOTE: Replace this with assembly.find_by_key after this is merged:
# https://github.com/compas-dev/compas/pull/1032
part = assembly.graph.node_attribute(str(int(part)), "part")

lbound = 0
ubound = 0
i = int(i)
total = sum([len(part.attributes[traj_name].points) for traj_name in trajectory_keys])
if i >= total:
    raise Exception('Max number of trajectory points is ' + str(total))
    
for traj_name in trajectory_keys:
    traj = part.attributes[traj_name]
    ubound += len(traj.points)

    if i >= ubound:
        lbound = ubound
        continue

    config = traj.points[i - lbound]
    acms = traj.attached_collision_meshes
    break
# ---------- end load_plans ----------

refresh = Button()
robot_visualize = RobotVisualize(
    robot=load.robot,
    configuration=load_plans.config,
    attached_collision_meshes=load_plans.acms,
    show_frames=True,
    show_acm=True)  # -> visual, collision, attached_meshes, frames, base_frame, ee_frame; inputs attached_collision_meshes: list, show_visual: Boolean, show_collision: Boolean, show_frames: Boolean, show_base_frame: Boolean, show_end_effector_frame: Boolean, show_acm: Boolean
#   port group: The planning group used for end-effector and base visualization.
#   port configuration: The robot's full configuration.
#   port attached_collision_meshes: A list of attached collision meshes.
#   port show_visual: Whether or not to show the robot's visual meshes.
#   port show_collision: Whether or not to show the robot's collision meshes.
#   port show_frames: Whether or not to show the robot's joint frames.
#   port show_base_frame: Whether or not to show the robot's base frame.
#   port show_end_effector_frame: Whether or not to show the robot's end-effector frame.
#   port show_acm: Whether or not to show the attached collision meshes (if any).
#   port visual: The robot's visual Rhino meshes (if any).
#   port collision: The robot's collision Rhino meshes (if any).
#   port attached_meshes: The attached collision Rhino meshes (if any).
#   port frames: The robot's joint frames as Rhino planes (if any).
#   port base_frame: The robot's base frame as a Rhino plane (if any).
#   port ee_frame: The robot's end-effector frame as a Rhino plane (if any).
# ---------- robot_visualize: Python ----------
"""
Visualizes the robot.

COMPAS FAB v0.22.0
"""
from compas.geometry import Transformation
from compas_ghpython.artists import FrameArtist
from compas_ghpython.artists import MeshArtist
from ghpythonlib.componentbase import executingcomponent as component


class RobotVisualize(component):
    def RunScript(self, robot, group, configuration, attached_collision_meshes, show_visual, show_collision,
                  show_frames, show_base_frame, show_end_effector_frame, show_acm):

        visual = None
        collision = None
        attached_meshes = None
        frames = None
        base_frame = None
        ee_frame = None

        if robot:
            show_visual = True if show_visual is None else show_visual
            configuration = configuration or robot.zero_configuration()

            robot.update(configuration, visual=show_visual, collision=show_collision)
            compas_frames = robot.transformed_frames(configuration, group)

            if show_visual:
                visual = robot.artist.draw_visual()

            if show_collision:
                collision = robot.artist.draw_collision()

            if show_base_frame:
                base_compas_frame = compas_frames[0]
                artist = FrameArtist(base_compas_frame)
                base_frame = artist.draw()

            if show_end_effector_frame:
                ee_compas_frame = robot.forward_kinematics(configuration, group, options=dict(solver='model'))
                artist = FrameArtist(ee_compas_frame)
                ee_frame = artist.draw()

            if show_frames:
                frames = []
                for compas_frame in compas_frames[1:]:
                    artist = FrameArtist(compas_frame)
                    frame = artist.draw()
                    frames.append(frame)

            if show_acm:
                attached_meshes = []
                for acm in attached_collision_meshes:
                    frame = robot.forward_kinematics(configuration, options=dict(solver='model', link=acm.link_name))
                    T = Transformation.from_frame_to_frame(acm.collision_mesh.frame, frame)
                    mesh = acm.collision_mesh.mesh.transformed(T)
                    attached_meshes.append(MeshArtist(mesh).draw())

        return (visual, collision, attached_meshes, frames, base_frame, ee_frame)
# ---------- end robot_visualize ----------
built_assembly = GhPythonScript(assembly=load.assembly, current_part=number_slider, only_until_current=Toggle(True))  # -> a
# ---------- built_assembly: Python ----------
from compas.artists import Artist
from compas.topology import breadth_first_ordering

a = []

root_part_key = "0"
sequence = breadth_first_ordering(assembly.graph.adjacency, root_part_key)
current_part = str(int(current_part))

for part_key in sequence:
    part = assembly.graph.node_attribute(part_key, "part")
    if only_until_current and str(part_key) == current_part:
        break
    mesh = part.geometry
    artist = Artist(mesh)
    a.append(artist.draw())
# ---------- end built_assembly ----------
planning_scene = GhPythonScript(robot=load.robot, refresh=refresh)  # -> a
# ---------- planning_scene: Python ----------
from compas_fab.robots import PlanningScene

from compas.artists import Artist
from compas.geometry import Frame
from compas.geometry import Transformation


scene = PlanningScene(robot)

collision_meshes = []
attached_collision_meshes = []

configuration = robot.zero_configuration()
scene = robot.client.get_planning_scene()

for co in scene.world.collision_objects:
    header = co.header
    frame_id = header.frame_id
    cms = co.to_collision_meshes()

    for cm in cms:
        if cm.frame != Frame.worldXY():
            t = Transformation.from_frame(cm.frame)
            mesh = cm.mesh.transformed(t)
        else:
            mesh = cm.mesh

        collision_meshes.append(mesh)

    for aco in scene.robot_state.attached_collision_objects:
        for acm in aco.to_attached_collision_meshes():
            frame_id = aco.object["header"]["frame_id"]
            frame = robot.forward_kinematics(configuration, options=dict(link=frame_id))
            t = Transformation.from_frame(frame)

            # Local CM frame
            if (acm.collision_mesh.frame and acm.collision_mesh.frame != Frame.worldXY()):
                t = t * Transformation.from_frame(acm.collision_mesh.frame)

            mesh = acm.collision_mesh.mesh.transformed(t)

            attached_collision_meshes.append(mesh)

a = []
for cm in collision_meshes + attached_collision_meshes:
    a.append(Artist(cm).draw_mesh())
# ---------- end planning_scene ----------
