# Grasshopper definition 801_robot_cell_test.ghx (Grasshopper 1.0.7)

# ----
# Robot model
connect = BooleanToggle(True)
ros = ROSConnect(connect=connect)  # -> ros_client, is_connected; inputs port: Int32, connect: Boolean
#   port ip: The ip address ROS. Defaults to 127.0.0.1.
#   port port: The port of ROS. Defaults to 9090.
#   port connect: If True, connects to ROS. If False, disconnects from ROS. Defaults to False.
#   port ros_client: The ROS client.
#   port is_connected: True if connection established.
# ---------- ros: Python ----------
"""
Connect or disconnect to ROS.

COMPAS FAB v0.22.0
"""
from ghpythonlib.componentbase import executingcomponent as component
from scriptcontext import sticky as st

from compas_fab.backends import RosClient
from compas_fab.ghpython.components import create_id


class ROSConnect(component):
    def RunScript(self, ip, port, connect):
        ros_client = None

        ip = ip or '127.0.0.1'
        port = port or 9090

        key = create_id(self, 'ros_client')
        ros_client = st.get(key, None)

        if ros_client:
            st[key].close()
        if connect:
            st[key] = RosClient(ip, port)
            st[key].run(5)

        ros_client = st.get(key, None)
        is_connected = ros_client.is_connected if ros_client else False
        return (ros_client, is_connected)
# ---------- end ros ----------
load_robot = BooleanToggle(True)
robot = ROSRobot(ros_client=ros.ros_client, load=load_robot)  # -> robot; inputs load: Boolean
#   port ros_client: The ROS client.
#   port load: If True, loads the robot from ROS. Defaults to False.
# ---------- robot: Python ----------
"""
Load robot directly from ROS.

COMPAS FAB v0.22.0
"""
from compas_ghpython.artists import RobotModelArtist
from ghpythonlib.componentbase import executingcomponent as component
from scriptcontext import sticky as st

from compas_fab.ghpython.components import create_id


class ROSRobot(component):
    def RunScript(self, ros_client, load):
        key = create_id(self, 'robot')

        if ros_client and ros_client.is_connected and load:
            # Load URDF from ROS
            st[key] = ros_client.load_robot(load_geometry=True, precision='12f')
            st[key].artist = RobotModelArtist(st[key].model)

        robot = st.get(key, None)
        if robot:  # client sometimes need to be restarted, without needing to reload geometry
            robot.client = ros_client
        return robot
# ---------- end robot ----------

# ----
# Static collision meshes
remove = Button()
add = Button()
scene = PlanningScene(robot=robot)  # -> scene
#   port scene: A planning scene.
# ---------- scene: Python ----------
"""
Create a planning scene.

COMPAS FAB v0.24.0
"""
from ghpythonlib.componentbase import executingcomponent as component
from scriptcontext import sticky as st

from compas_fab.ghpython.components import create_id
from compas_fab.robots import PlanningScene


class PlanningSceneComponent(component):
    def RunScript(self, robot):
        key = create_id(self, 'planning_scene')
        if robot:
            st[key] = PlanningScene(robot)
        return st.get(key, None)
# ---------- end scene ----------
mesh = Mesh(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)
mesh_2 = Mesh(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)
cm = CollisionMesh(scene=scene, mesh=mesh, identifier="table", add=add, remove=remove)  # -> ok; inputs mesh: Mesh, add: Boolean, remove: Boolean
#   port scene: The planning scene.
#   port mesh: A collision mesh.
#   port identifier: The identifier of the collision mesh.
#   port add: If True, adds the collision mesh to the planning scene.
#   port remove: If True, removes the collision mesh from the planning scene.
#   port ok: True if the operation was successfully performed.
# ---------- cm: Python ----------
"""
Add or remove a collision mesh from the planning scene.

COMPAS FAB v0.24.0
"""
from compas_rhino.geometry import RhinoMesh
from ghpythonlib.componentbase import executingcomponent as component

from compas_fab.robots import CollisionMesh


class CollisionMeshComponent(component):
    def RunScript(self, scene, M, name, add, remove):
        ok = False
        if scene and M and name:
            mesh = RhinoMesh.from_geometry(M).to_compas()
            collision_mesh = CollisionMesh(mesh, name)
            if add:
                scene.add_collision_mesh(collision_mesh)
                ok = True
            if remove:
                scene.remove_collision_mesh(name)
                ok = True
        return ok
# ---------- end cm ----------
cm_2 = CollisionMesh(scene=scene, mesh=mesh_2, identifier="wall", add=add, remove=remove)  # -> ok; inputs mesh: Mesh, add: Boolean, remove: Boolean; same code as cm

# ----
# Tool
number_slider = Slider(-0.0433, range=-0.1..0.1)
tool = GhPythonScript(attached=Toggle(True), z_offset=number_slider)  # -> tool
# ---------- tool: Python ----------
import os
from compas.datastructures import Mesh
from compas.geometry import Frame
from compas_fab.robots import Tool

HERE = os.path.dirname(ghenv.Component.OnPingDocument().FilePath)

if attached:
    vmesh = Mesh.from_stl(os.path.join(HERE, 'vacuum-gripper-visual.stl'))
    cmesh = Mesh.from_stl(os.path.join(HERE, 'vacuum-gripper-collision.stl'))
    frame = Frame([0, 0, z_offset], [1, 0, 0], [0, 1, 0])
    tool = Tool(visual=vmesh, frame_in_tool0_frame=frame, collision=cmesh)
# ---------- end tool ----------

path = GhPythonScript(filename="assembly.json")  # -> path
# ---------- path: Python ----------
import os

HERE = os.path.dirname(ghenv.Component.OnPingDocument().FilePath)
path = os.path.join(HERE, filename)
# ---------- end path ----------
load = GhPythonScript(filename=path, tool=tool, robot=robot, reload=Button())  # -> robot, assembly
# ---------- load: Python ----------
import os
import compas
from compas.datastructures import Assembly
from compas_fab.robots import Tool

if filename:
    if os.path.exists(filename):
        assembly = compas.json_load(filename)
    else:
        assembly = Assembly()
        compas.json_dump(assembly, filename, pretty=True)

    if tool:
        assembly.attributes['tool'] = tool.data
        robot.attach_tool(tool)
    else:
        if robot.attached_tool:
            robot.detach_tool()

    compas.json_dump(assembly, filename, pretty=True)
# ---------- end load ----------

# ----
# Pickup frame
pt = Point(Point(0.3, 0.52, 0.037))
xy = XYPlane(Origin=pt)
rot3d = Rotate3D(Geometry=xy, Angle=3.141592654, Center=pt, Axis=Vector(0, 0, 1))  # -> Geometry, Transform
pflip = FlipPlane(Plane=rot3d.Geometry, ReverseX=False, ReverseY=False, SwapAxes=True)

python = GhPythonScript(ros=ros.ros_client)  # -> abb
# ---------- python: Python ----------
__author__ = "kchadha"
__version__ = "2022.05.04"

import rhinoscriptsyntax as rs
import compas_rrc as rrc


abb = rrc.AbbClient(ros, '/rob1')
# ---------- end python ----------
python_2 = GhPythonScript(f=pflip)  # -> out, frame
# ---------- python_2: Python ----------
import compas_rrc as rrc
from compas.geometry import *
from compas_rhino.geometry import RhinoPlane

scale = 1000

frame = RhinoPlane.from_geometry(f).to_compas_frame()
frame = frame.transformed(Scale.from_factors([scale]*3))
# ---------- end python_2 ----------

# ---- group: Send text
python_3 = GhPythonScript(abb=python)  # -> out, a
# ---------- python_3: Python ----------
import compas_rrc as rrc

abb.send(rrc.PrintText('Hi'))
# ---------- end python_3 ----------

# ----
robot_visualize = RobotVisualize(robot=load.robot)  # -> visual, collision, attached_meshes, frames, base_frame, ee_frame; inputs attached_collision_meshes: list, show_visual: Boolean, show_collision: Boolean, show_frames: Boolean, show_base_frame: Boolean, show_end_effector_frame: Boolean, show_acm: Boolean
#   port group: The planning group used for end-effector and base visualization.
#   port configuration: The robot's full configuration.
#   port attached_collision_meshes: A list of attached collision meshes.
#   port show_visual: Whether or not to show the robot's visual meshes.
#   port show_collision: Whether or not to show the robot's collision meshes.
#   port show_frames: Whether or not to show the robot's joint frames.
#   port show_base_frame: Whether or not to show the robot's base frame.
#   port show_end_effector_frame: Whether or not to show the robot's end-effector frame.
#   port show_acm: Whether or not to show the attached collision meshes (if any).
#   port visual: The robot's visual Rhino meshes (if any).
#   port collision: The robot's collision Rhino meshes (if any).
#   port attached_meshes: The attached collision Rhino meshes (if any).
#   port frames: The robot's joint frames as Rhino planes (if any).
#   port base_frame: The robot's base frame as a Rhino plane (if any).
#   port ee_frame: The robot's end-effector frame as a Rhino plane (if any).
# ---------- robot_visualize: Python ----------
"""
Visualizes the robot.

COMPAS FAB v0.24.0
"""
from compas.geometry import Frame
from compas.geometry import Transformation
from compas_ghpython.artists import FrameArtist
from compas_ghpython.artists import MeshArtist
from ghpythonlib.componentbase import executingcomponent as component


class RobotVisualize(component):
    def RunScript(self, robot, group, configuration, attached_collision_meshes, show_visual, show_collision,
                  show_frames, show_base_frame, show_end_effector_frame, show_acm):

        visual = None
        collision = None
        attached_meshes = None
        frames = None
        base_frame = None
        ee_frame = None

        if robot:
            show_visual = True if show_visual is None else show_visual
            configuration = configuration or robot.zero_configuration()

            robot.update(configuration, visual=show_visual, collision=show_collision)
            compas_frames = robot.transformed_frames(configuration, group)

            if show_visual:
                visual = robot.artist.draw_visual()

            if show_collision:
                collision = robot.artist.draw_collision()

            if show_base_frame:
                base_compas_frame = compas_frames[0]
                artist = FrameArtist(base_compas_frame)
                base_frame = artist.draw()

            if show_end_effector_frame:
                ee_compas_frame = robot.forward_kinematics(configuration, group, options=dict(solver='model'))
                artist = FrameArtist(ee_compas_frame)
                ee_frame = artist.draw()

            if show_frames:
                frames = []
                for compas_frame in compas_frames[1:]:
                    artist = FrameArtist(compas_frame)
                    frame = artist.draw()
                    frames.append(frame)

            if show_acm:
                attached_meshes = []
                for acm in attached_collision_meshes:
                    frame = robot.forward_kinematics(configuration, options=dict(solver='model', link_name=acm.link_name))
                    T = Transformation.from_frame_to_frame(Frame.worldXY(), frame)
                    mesh = acm.collision_mesh.mesh.transformed(T)
                    attached_meshes.append(MeshArtist(mesh).draw())

        return (visual, collision, attached_meshes, frames, base_frame, ee_frame)
# ---------- end robot_visualize ----------
refresh = Button()
planning_scene = GhPythonScript(robot=load.robot, refresh=refresh)  # -> a
# ---------- planning_scene: Python ----------
from compas_fab.robots import PlanningScene

from compas.artists import Artist
from compas.geometry import Frame
from compas.geometry import Transformation


scene = PlanningScene(robot)

collision_meshes = []
attached_collision_meshes = []

configuration = robot.zero_configuration()
scene = robot.client.get_planning_scene()

for co in scene.world.collision_objects:
    header = co.header
    frame_id = header.frame_id
    cms = co.to_collision_meshes()

    for cm in cms:
        if cm.frame != Frame.worldXY():
            t = Transformation.from_frame(cm.frame)
            mesh = cm.mesh.transformed(t)
        else:
            mesh = cm.mesh

        collision_meshes.append(mesh)

    for aco in scene.robot_state.attached_collision_objects:
        for acm in aco.to_attached_collision_meshes():
            frame_id = aco.object["header"]["frame_id"]
            frame = robot.forward_kinematics(configuration, options=dict(link=frame_id))
            t = Transformation.from_frame(frame)

            # Local CM frame
            if (acm.collision_mesh.frame and acm.collision_mesh.frame != Frame.worldXY()):
                t = t * Transformation.from_frame(acm.collision_mesh.frame)

            mesh = acm.collision_mesh.mesh.transformed(t)

            attached_collision_meshes.append(mesh)

a = []
for cm in collision_meshes + attached_collision_meshes:
    a.append(Artist(cm).draw_mesh())
# ---------- end planning_scene ----------

# ---- group: Send to the Robot
python_4 = GhPythonScript(abb=python, frame=python_2.frame, send=Button())  # -> out, a
# ---------- python_4: Python ----------
import compas_rrc as rrc

#abb.send(rrc.PrintText('Hi'))

if send:
    speed = 30 #mm/s
    abb.send(rrc.MoveToFrame(frame,speed,rrc.Zone.FINE))
    abb.send(rrc.SetDigital('doUnitC106Out2',0))
# ---------- end python_4 ----------
