# Grasshopper definition 802_assemblies.ghx (Grasshopper 1.0.7)

# ----
# Part
number_slider = Slider(0.012, range=0.01..0.05)
part = GhPythonScript(width=Slider(0.031, range=0.01..0.05), depth=Slider(0.016, range=0.01..0.05), height=number_slider)  # -> a, part
# ---------- part: Python ----------
from compas.geometry import Box
from compas.artists import Artist

part = Box.from_diagonal([(width / -2., depth / -2., 0), (width / 2., depth / 2., height)])
a = Artist(part).draw()
# ---------- end part ----------

pt = Point(Point(0.02185137782, 0.3293092432, 0.0252687))
pt_2 = Point(Point(-0.05911353982, 0.3983855095, 0.0252687))
pt_3 = Point(Point(0.05590621491, 0.4914810863, 0.0252687))
pt_4 = Point(Point(-0.02050866573, 0.5904484927, 0.0252687))
shape = Data(part.part)
num_bricks_per_row = Slider(7, range=0..100)
number_slider_2 = Slider(0.0005, range=0..0.001)
pt_5 = Point([pt, pt_2, pt_3, pt_4])
python = GhPythonScript(points=pt_5, shape=shape, num_rows=Slider(6, range=0..10), tolerance_height=number_slider_2)  # -> curves; inputs points: list, num_rows: Int32
# ---------- python: Python ----------
import Rhino.Geometry as rg
from compas.geometry import project_points_line

height = shape.zsize

ptS, ptA, ptB, ptE = points
line = ptS, ptE
ptAj, ptBj = project_points_line([ptA, ptB], line)
ptAj, ptBj = rg.Point3d(*ptAj), rg.Point3d(*ptBj)
stepA = (ptAj - ptA)/(num_rows - 1)
stepB = (ptBj - ptB)/(num_rows - 1)
up = rg.Vector3d(0, 0, height + tolerance_height)

curves = []
for i, r in enumerate(range(num_rows)):
    crv = rg.Curve.CreateControlPointCurve(points, 3)
    curves.append(crv)
    points = [p + up for p in points]
    points[1] += stepA
    points[2] += stepB
# ---------- end python ----------
python_2 = GhPythonScript(curves=python, num_bricks=num_bricks_per_row, shape=shape)  # -> assembly; inputs curves: list, num_bricks: Int32
# ---------- python_2: Python ----------
from compas.datastructures import Mesh
from compas.geometry import Translation
from compas.geometry import Vector
from compas.geometry import Frame
from compas.geometry import Polyhedron

## Start assembly definition
from compas.datastructures import Assembly
from compas.datastructures import Part

assembly = Assembly("assembly-exercise")
assembly.attributes['brick_shape'] = shape

key = 0

for k, crv in enumerate(curves):
    length = crv.GetLength()
    if k % 2 == 0:
        ts = crv.LengthParameter(shape.width/2)[1]
        te = crv.LengthParameter(length - shape.width/2)[1]
        params = crv.Trim(ts, te).DivideByCount(num_bricks - 1, True)
    else:
        params = crv.DivideByCount(num_bricks, True)
        params[0] = crv.LengthParameter(shape.depth/2)[1]
        params[-1] = crv.LengthParameter(length - shape.depth/2)[1]

    for j, t in enumerate(params):
        x, y, z = 0, 0, (shape.height / 2)
        point = crv.PointAt(t)
        tangent = crv.TangentAt(t)
        yaxis = Vector(0,0,1).cross(tangent)
        
        if k % 2 == 1 and j in [0, len(params) - 1]:
            frame = Frame(point, yaxis, -tangent)
        else:
            frame = Frame(point, tangent, yaxis)

        frame = frame.transformed(Translation.from_vector([x, y, z]))
        polyhedron = Polyhedron(*shape.to_vertices_and_faces())
        element = Part(frame=frame, shape=polyhedron)
        assembly.add_part(element, key)
        key += 1
# ---------- end python_2 ----------

pt_6 = Point(Point(-0.03456377353, 0.3150082218, 0.02317093263))
shape_2 = Data(part.part)
python_3 = GhPythonScript(
    point=pt_6,
    shape=shape_2,
    num_rows=Slider(9, range=0..10),
    tolerance_height=number_slider_2,
    offset=Slider(0.002, range=0..0.01))  # -> assembly; inputs num_rows: Int32
# ---------- python_3: Python ----------
from compas.geometry import Translation
from compas.geometry import Vector
from compas.geometry import Point
from compas.geometry import Frame
from compas.geometry import Polyhedron
import Rhino.Geometry as rg

## Start assembly definition
from compas.datastructures import Assembly
from compas.datastructures import Part

assembly = Assembly("assembly-exercise")
assembly.attributes['brick_shape'] = shape

key = 0

for row in range(num_rows):
    
    x, y, z = 0, 0, (shape.height / 2)
    
    p = Point(*list(point))
    z = p.z
    print z
    p.z = row * (shape.height + tolerance_height)
    
    if row % 2 == 0:
        v = Vector(1, 0, 0)
        xaxis = Vector(0, 1, 0)
        yaxis = Vector(-1, 0, 0)
    else:
        v = Vector(0, 1, 0)
        xaxis = Vector(1, 0, 0)
        yaxis = Vector(0, 1, 0)
        
    pointA = p - v * (shape.depth/2 + offset)
    pointB = p + v * (shape.depth/2 + offset)
    frameA = Frame(pointA, xaxis, yaxis)
    frameB = Frame(pointB, xaxis, yaxis)
    
    for frame in [frameA, frameB]:
        frame = frame.transformed(Translation.from_vector([x, y, z]))
        polyhedron = Polyhedron(*shape.to_vertices_and_faces())
        element = Part(frame=frame, shape=polyhedron)
        assembly.add_part(element, key)
        key += 1
# ---------- end python_3 ----------

num_bricks_per_row_2 = Slider(10, range=0..100)
shape_3 = Data(part.part)
crv = Curve(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)
python_4 = GhPythonScript(curves=crv, num_bricks=num_bricks_per_row_2, shape=shape_3)  # -> assembly; inputs curves: list, num_bricks: Int32
# ---------- python_4: Python ----------
from compas.geometry import Translation
from compas.geometry import Vector
from compas.geometry import Frame
from compas.geometry import Polyhedron
from compas.datastructures import Assembly
from compas.datastructures import Part

assembly = Assembly("assembly-exercise")
assembly.attributes['brick_shape'] = shape

key = 0

for k, crv in enumerate(curves):
    length = crv.GetLength()
    if k % 2 == 0:
        ts = crv.LengthParameter(shape.width/2)[1]
        te = crv.LengthParameter(length - shape.width/2)[1]
        params = crv.Trim(ts, te).DivideByCount(num_bricks - 1, True)
    else:
        params = crv.DivideByCount(num_bricks, True)
        params[0] = crv.LengthParameter(shape.depth/2)[1]
        params[-1] = crv.LengthParameter(length - shape.depth/2)[1]

    for j, t in enumerate(params):
        x, y, z = 0, 0, (shape.height / 2)
        point = crv.PointAt(t)
        tangent = crv.TangentAt(t)
        yaxis = Vector(0,0,1).cross(tangent)
        
        if k % 2 == 1 and j in [0, len(params) - 1]:
            frame = Frame(point, yaxis, -tangent)
        else:
            frame = Frame(point, tangent, yaxis)

        frame = frame.transformed(Translation.from_vector([x, y, z]))
        polyhedron = Polyhedron(*shape.to_vertices_and_faces())
        element = Part(frame=frame, shape=polyhedron)
        assembly.add_part(element, key)
        key += 1
# ---------- end python_4 ----------

pt_7 = Point([Point(-0.2668817432, 0.4642499868, 0.02526872791), Point(-0.1891942409, 0.4211626299, 0.02526872791), Point(-0.1408473182, 0.3260170896, 0.02526872791)])
assembly = GhPythonScript(points=pt_7, rows=Slider(6, range=1..20), part_shape=part.part)  # -> frames, curve, bricks, wall; inputs points: list
# ---------- assembly: Python ----------
from compas.artists import Artist
from compas.datastructures import Assembly
from compas.datastructures import Part
from compas.geometry import Box
from compas.geometry import Polyhedron
from compas.geometry import Frame
from compas.geometry import Transformation
from compas.geometry import Translation
from compas.geometry import NurbsCurve
from compas_rhino.conversions import RhinoPoint

# Create Wall as Assembly instance
wall = Assembly("assembly-exercise")
wall.attributes['brick_shape'] = part_shape

# Create wall curve
points = [RhinoPoint.from_guid(p).to_compas() for p in points]
curve = NurbsCurve.from_interpolation(points)

HGAP = 0.005
VGAP = 0.002
divisions = curve.divide_by_length(part_shape.width + HGAP)

# Create brick frames
frames = []
key = 0
for row in range(int(rows)):
    Trow = Translation.from_vector((0, 0, part_shape.height / 2. + (part_shape.height + VGAP) * row))

    for div, i in zip(divisions, range(len(divisions))):
        point = curve.point_at(div)
        xaxis = curve.tangent_at(div)
        yaxis = xaxis.cross((0, 0, 1))
        frame = Frame(point, xaxis, yaxis)

        # Create bricks as parts
        width, height, depth = part_shape.width, part_shape.height, part_shape.depth
        brick_type = 'full'
#        if row % 2 == 1 and i % len(divisions) == 0:
#            brick_type = 'half'
#        if row % 2 == 0 and i % (len(divisions)) == len(divisions)-1:
#            brick_type = 'half'

        if brick_type == 'half':
            width = width / 2.
            xoffset = width / 2.
        else:
            xoffset = width / 2. if row % 2 == 0 else 0

        shape = Box.from_width_height_depth(width, height, depth)
        shape = Polyhedron(*shape.to_vertices_and_faces())

        Tb = Translation.from_vector((xoffset, 0, 0))
        Tf = Transformation.from_frame(frame)
        frame = Frame.from_transformation(Trow * Tf * Tb)
        frames.append(frame)

        part = Part(frame=frame, shape=shape)
        wall.add_part(part, key=str(key))
        key += 1


frames = [Artist(f).draw() for f in frames]
curve = Artist(curve).draw()
bricks = [Artist(brick.geometry).draw() for brick in wall.parts()]
# ---------- end assembly ----------
geo = Geometry(assembly.frames)
geo_2 = Geometry(assembly.curve)
geo_3 = Geometry(assembly.bricks)

# ----
# Example assemblies
number_slider_3 = Slider(0, range=0..3)
filter = StreamFilter(Gate=number_slider_3, Stream0=assembly.wall, Stream1=python_2, Stream2=python_3, Stream3=python_4)
preview = GhPythonScript(assembly=filter)  # -> elements
# ---------- preview: Python ----------
from compas_fab.robots import JointTrajectory
from compas.artists import Artist


elements = []
for j, part in enumerate(assembly.parts()):
    print j, part
    geom = part.geometry
    mesh = Artist(geom).draw()
    elements.append(mesh)

    fa = Artist(part.frame, scale=.02)
    a = fa.draw()
    elements.extend(a)
#    elements.extend(b)
# ---------- end preview ----------

# ----
# Save
panel = Panel("assembly.json")
path = GhPythonScript(filename=panel)  # -> path
# ---------- path: Python ----------
import os

HERE = os.path.dirname(ghenv.Component.OnPingDocument().FilePath)
path = os.path.join(HERE, filename)
# ---------- end path ----------
to_json = ToJSON(data=filter, filepath=path, pretty=Toggle(True))  # -> json; inputs pretty: Boolean
#   port data: COMPAS data objects to serialize.
#   port filepath: File path where to store the JSON file. If empty, it will not store to disk but instead return the JSON string.
#   port pretty: If True, JSON data will be formatted with indentation and key sorting.
#   port json: JSON file path or JSON string.
# ---------- to_json: Python ----------
"""
Serializes COMPAS objects to JSON.
"""
from ghpythonlib.componentbase import executingcomponent as component

import compas


class CompasInfo(component):
    def RunScript(self, data, filepath, pretty):
        json = filepath

        if filepath:
            compas.json_dump(data, filepath, pretty)
        else:
            json = compas.json_dumps(data, pretty)

        return json
# ---------- end to_json ----------
