# Grasshopper definition Shape.gh (Grasshopper 1.0.7)

series = Series(Start=0, Step=3, Count=Slider(100, range=0..100))
crv = Curve(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)
Z = UnitZ(Factor=series)
move = Move(Geometry=crv, Motion=Z)  # -> Geometry, Transform
lng = ListLength(List=move.Geometry)
range = Range(Domain=Domain(0, 1), Steps=expr("x-1", lng))
graph = GraphMapper(range, x0=0, x1=1, y0=0, y1=1, container_name="Sine", Equation_px=[0, 0.8859221935], Equation_py=[0, 0.989977181])
rotate = Rotate(Geometry=move.Geometry, Angle=graph, Plane=PlaneXY(0, 0, 0))  # -> Geometry, Transform
range_2 = Range(Domain=Domain(1, 0.8), Steps=expr("x-1", lng))
graph_2 = GraphMapper(range_2, x0=0, x1=1, y0=0, y1=1, container_name="Sine", Equation_px=[0, 0.8859221935], Equation_py=[0, 0.989977181])
scale_nu = ScaleNU(Geometry=rotate.Geometry, Plane=PlaneXY(0, 0, 0), ScaleX=graph_2, ScaleY=graph_2, ScaleZ=1)  # -> Geometry, Transform
X = UnitX(Factor=1)
range_3 = Range(Domain=Domain(0, 0.2), Steps=expr("x-1", lng))
area = Area(Geometry=scale_nu.Geometry)  # -> Area, Centroid
graph_3 = GraphMapper(range_3, x0=0, x1=1, y0=0, y1=1, container_name="Sine", Equation_px=[0, 0.3733502924], Equation_py=[0, 0.8976298571])
loft = Loft(
    Curves=flatten(scale_nu.Geometry),
    Options={Adjust=False, Closed=False, LoftEnds=0, LoftSimp=0, LoftType=0, Rebuild=10, Refit=0.01})
tri = Triangulate(Mesh=loft)  # -> Mesh, Count
mesh = Mesh()
